# Grasshopper definition 230221_yuki_fixing_brackets.gh (Grasshopper 1.0.7)
# plug-ins: treesloth01

# ---- group: width
number_slider = Slider(7, range=0..100)

# ---- group: length
number_slider_2 = Slider(20, range=0..100)

# ---- group: thickness
number_slider_3 = Slider(4, range=0..100)

# ---- group: number of brackets
number_slider_4 = Slider(5, range=0..10)

# ----
# Input baked geometry to generate holding brackets
number_slider_5 = Slider(50, range=0..200)
# Adjust threshold and distance b/w brackets as needed
# Press bake to bake!
number_slider_6 = Slider(76.8, range=0..300)
brep = Brep([<brep referenced from the Rhino model> x20])
python = GhPythonScript(breps=brep, ids=brep, threshold=number_slider_5, distance=number_slider_6, bake=Button(), bake_box=Button())  # -> out, intersections, circs, tags; inputs breps: list of Brep, ids: list of Guid
# ---------- python: Python ----------
import Rhino.Geometry as rg
from ghpythonlib.treehelpers import list_to_tree as tree
import scriptcontext as sc
import Rhino.DocObjects as rd
import Rhino.DocObjects.ObjectAttributes as obj_att
from Rhino.RhinoDoc import ActiveDoc as doc
from Grasshopper.Kernel.GH_Convert import ToGUID as guid
import System.Collections.Generic.IEnumerable as IEnumerable
import System
import Rhino
from System import Array
from ghpythonlib.components import FilletEdge
import random as r

def GetObjectLayer(x):
    obj = doc.Objects.Find(x)
    index = obj.Attributes.LayerIndex
    layer = doc.Layers[index]
    return layer.Name

class Intersection(object):
    def __init__(self,crvs,layer,breps,layers):
        self.crvs = crvs
        self.layer = layer
        self.layers = layers
        self.breps = breps

def bake_object(obj,lay,col = 25):
    if obj is not None:
        attr = Rhino.DocObjects.ObjectAttributes()
    if lay is not None: # setting layer
        if rd.Layer.IsValidName(lay):
            layerIndex = sc.doc.Layers.Find(lay, True)
            if layerIndex < 0: # if the layer doesn't exist
                layer = rd.Layer()
                layer.Name = lay
                layer.Color = System.Drawing.Color.FromArgb(255,r.randint(0,255),0,r.randint(0,255))
                layerIndex = sc.doc.Layers.Add(layer)
            attr.LayerIndex = layerIndex
    
#    displayColor = Rhino.Display.ColorRGBA(layerIndex)
    sc.doc.Objects.AddBrep(obj, attr)

FAB_TOL = 0.15

B_TAGS = ('TO','BO','LF','RI','BA','IT','IB','IL','IR')

inter_radius = 10.0

intersections = []
for brep0,id0 in zip(breps,ids):
    layer0 = GetObjectLayer(id0)
    for brep1,id1 in zip(breps,ids):
        layer1 = GetObjectLayer(id1)
        if (brep0 is not brep1) and (("%s-%s"%(layer0,layer1) not in [int.layer for int in intersections])) and (("%s-%s"%(layer1,layer0) not in [int.layer for int in intersections])) and (layer1 not in B_TAGS or layer0 not in B_TAGS):
#            print ("%s-%s"%(layer0,layer1)),"%s-%s"%(layer1,layer0), [int.layer for int in intersections]
            bbx = rg.Intersect.Intersection.BrepBrep(brep0,brep1,0.001)
            if bbx and len(bbx[1])>0:
                list_intersections = []
                for bx in bbx[1]:
                    if bx.GetLength() > 25:
                        list_intersections.append(bx)
                    else:
                        print 'small'
                interX = Intersection(list_intersections,"%s-%s"%(layer0,layer1),[brep0,brep1],[layer0,layer1])
                intersections.append(interX)

circs,tags = [],[]
for inter in intersections:
    for crv in inter.crvs:
        ts =  crv.DivideByCount(2,True)
        point,end = crv.PointAt(ts[1]),crv.PointAt(ts[2])
        if crv.GetLength()>distance*3:
            d_count = crv.GetLength()//distance
            params = crv.DivideByCount(d_count,True)
            pts = [crv.PointAt(t) for t in params[1:len(params)-1]]
        else:
            pts = [point]
        for pt in pts:
            pln = rg.Plane(pt,rg.Vector3d(end-point))
            circ = rg.Circle(rg.Plane(pt,rg.Vector3d(end-point)),inter_radius).ToNurbsCurve()
            plane = rg.Brep.CreatePlanarBreps([circ])[0]
            bpx0 = rg.Intersect.Intersection.BrepBrep(inter.breps[0],plane,0.001)
            bpx1 = rg.Intersect.Intersection.BrepBrep(inter.breps[1],plane,0.001)
            cutters = []
            if bpx0 and bpx1:
                cutters.extend([curve for curve in bpx0[1]])
                cutters.extend([curve for curve in bpx1[1]])
                cuts = plane.Split.Overloads[IEnumerable[rg.Curve], System.Double](cutters,0.001)
                for cut in cuts:
                    count = 0
                    pcount = 0
                    flag = 0
                    for edge in cut.Edges:
                        count += 1
                        if edge.Degree == 1:
                            pcount += 1
                    if count>4 and cut.GetArea()>threshold and pcount>3:
                        edge_curves = [edge.EdgeCurve for edge in cut.Edges if edge.Degree == 1]
                        edge_curves.sort(key = lambda e :e.GetLength())
                        edge_count = 0
                        for e in edge_curves:
                            if abs(e.GetLength() - inter_radius) < 0.1:
                                big_edge = e
                            edge_count +=1
                        small_edge = (edge_curves[3]) if (big_edge.ClosestPoint(edge_curves[1].PointAtStart,7.5)[0] or big_edge.ClosestPoint(edge_curves[1].PointAtEnd,7.5)[0]) and abs(edge_curves[1].GetLength()) > edge_curves[3].GetLength() else (edge_curves[3])
                        if edge_count<5:
                            small_edge = edge_curves[2]
            #           small_edge = edge_curves[3] if edge_curves[2].GetLength()>edge_curves[3].GetLength() else edge_curves[2]
                        p0,p1 = (small_edge.PointAtStart,small_edge.PointAtEnd) if big_edge.ClosestPoint(small_edge.PointAtStart,7.5)[0] else (small_edge.PointAtEnd,small_edge.PointAtStart)
                        if big_edge.ClosestPoint(small_edge.PointAtStart,7.5)[0] and big_edge.ClosestPoint(small_edge.PointAtStart,7.5)[0]:
                            print big_edge.ClosestPoint(small_edge.PointAtStart,7.5)[1],big_edge.ClosestPoint(small_edge.PointAtEnd,7.5)[1]
                            closest_pt_start = big_edge.PointAt(big_edge.ClosestPoint(small_edge.PointAtStart,7.5)[1])
                            start_dist = closest_pt_start.DistanceTo(small_edge.PointAtStart)
                            closest_pt_end = big_edge.PointAt(big_edge.ClosestPoint(small_edge.PointAtEnd,7.5)[1])
                            end_dist = closest_pt_end.DistanceTo(small_edge.PointAtEnd)
                            if start_dist<end_dist:
                                p0,p1 = small_edge.PointAtStart,small_edge.PointAtEnd
                            else:
                                p0,p1 = small_edge.PointAtEnd,small_edge.PointAtStart
                        pp0,pp1 = (big_edge.PointAtStart,big_edge.PointAtEnd) if small_edge.ClosestPoint(big_edge.PointAtStart,7.5)[0] else (big_edge.PointAtEnd,big_edge.PointAtStart)
                        #rebuild small and big edge for length
                        vec = rg.Vector3d(p1 - p0)
                        line = rg.Line(p0,vec,25.0 + FAB_TOL).ToNurbsCurve()
                        small_edge = line
                        vec1 = rg.Vector3d(pp1 - pp0)
                        line1 = rg.Line(pp0,vec1,25.0 + FAB_TOL).ToNurbsCurve()
                        big_edge = line1
                        big_edge.Domain = rg.Interval(0,1)
                        c_pt = big_edge.PointAt(0.5)
                        clo_pt0 = (inter.breps[0]).ClosestPoint(c_pt,1.0) 
                        clo_pt1 = (inter.breps[1]).ClosestPoint(c_pt,1.0)
                        guide_vec = (clo_pt0[5]) if (clo_pt0[0]) else None
                        print inter.layer
                        #push back big_edge
                        box_type = 0
                        if not (inter.layer.Split('-')[0] in B_TAGS or inter.layer.Split('-')[1] in B_TAGS):
                            if guide_vec is None and clo_pt1[0] :
                                guide_vec = clo_pt1[5]
                            guide_vec.Unitize()
                            guide_vec *= -3.20
                            big_edge.Translate(guide_vec)
                        else:
                            box_type = 1
                        if small_edge and big_edge is not None:
                            fil = rg.Curve.CreateFilletCurves(small_edge,p0,big_edge,pp0,0,True,True,True,True,0.01)
                            print fil
#                            rg.PolyCurve.SegmentCurve
                            if fil[0].SegmentCount<2 or min([fil[0].SegmentCurve(i).GetLength() for i in range(fil[0].SegmentCount)])<20:
                                print 'fli'
                                fil = rg.Curve.CreateFilletCurves(small_edge,p0,big_edge, pp1,0,True,True,True,True,0.01)
                            fil = fil[0] if len(fil)==1 else None
                            off = fil.Offset(rg.Point3d((fil.PointAtEnd+fil.PointAtStart)/2),rg.Plane(fil.PointAtEnd,fil.PointAtStart,fil.PointAt(0.5)).ZAxis,3.2,0.01,0.01,False,rg.CurveOffsetCornerStyle.Sharp,rg.CurveOffsetEndStyle.Flat)
                            if not box_type: b1,b2 = rg.Extrusion.Create(off[0].ToNurbsCurve(),9.0 + FAB_TOL, True),rg.Extrusion.Create(off[0].ToNurbsCurve(),-9.0 - FAB_TOL,True)
                            else : b1,b2 = rg.Extrusion.Create(off[0].ToNurbsCurve(),15.0 + FAB_TOL, True),rg.Extrusion.Create(off[0].ToNurbsCurve(),-15.0 - FAB_TOL,True)
                            if b1 and b2 is not None:
                                x1 = b1.ToBrep()
                                x2 = b2.ToBrep()
                                bool = rg.Brep.CreateBooleanUnion([x1,x2],0.001)
                                if len(bool)==1:
                                    bool[0].MergeCoplanarFaces(0.00,0.001)
                                    bool = bool[0]
                                else:
                                    print 'Boolean not created, check breps'
                            else:
                                print 'Bad Offset Curve, Extrusion not created.'
                            fillet_indices = []
                            
                            for edge in bool.Edges:
                                if abs(edge.EdgeCurve.GetLength() - 3.2) < 0.5:
                                    num =  edge.EdgeIndex
                                    fillet_indices.append(num)
                            indices = fillet_indices
                            bbe = rg.Brep.CreateFilletEdges(bool,indices,[2.0 for _ in range(len(indices))],[2.0 for _ in range(len(indices))],rg.BlendType.Fillet,rg.RailType.RollingBall,0.0001)
                        bbe = bbe[0]
                        circs.append([small_edge,big_edge,cut])
                        circs.append(bbe)
                        tags.append(inter.layer)
    
sc.doc = doc

for tag in tags:
    if tag.Split('-')[0] in B_TAGS or tag.Split('-')[1] in B_TAGS:
        pass

if bake:
    for part,tag in zip(circs,tags):
        bake_object(part,tag)

if bake_box:
    for part,tag in zip(circs,tags):
        if tag.Split('-')[0] in B_TAGS or tag.Split('-')[1] in B_TAGS:
            bake_object(part,tag)
    
sc.doc = ghdoc

intersections = intersections
circs = tree(circs)
# ---------- end python ----------
python_2 = GhPythonScript(inter=python.intersections)  # -> out, a, b; inputs inter: list
# ---------- python_2: Python ----------
import Rhino.Geometry as rg

a,b= [],[]
for int in inter:
    a.extend(int.crvs)
    b.append(int.layer)
# ---------- end python_2 ----------

brep_2 = Brep(<brep referenced from the Rhino model>)
brep_3 = Brep(<brep referenced from the Rhino model>)
deconstruct_brep = DeconstructBrep(Brep=brep_3)  # -> Faces, Edges, Vertices
brep_brep = BrepBrep(BrepA=brep_2, BrepB=brep_3)  # -> Curves, Points
deconstruct_brep_2 = DeconstructBrep(Brep=brep_2)  # -> Faces, Edges, Vertices
panel = Panel(brep_brep.Curves)
area = Area(Geometry=deconstruct_brep.Faces)  # -> Area, Centroid
curve = Curve(python_2.a)
list_item = ListItem(List=deconstruct_brep.Faces, Index=Slider(12, range=0..23), Wrap=True)
area_2 = Area(Geometry=deconstruct_brep_2.Faces)  # -> Area, Centroid
list_item_2 = ListItem(List=deconstruct_brep_2.Faces, Index=Slider(12, range=0..23), Wrap=True)
list_item_3 = ListItem(List=brep_brep.Curves, Index=Slider(0, range=0..1), Wrap=True)
sort_list = SortList(Keys=area.Area, ValuesA=deconstruct_brep.Faces)  # -> Keys, reverse(ValuesA)
sort_list_2 = SortList(Keys=area_2.Area, ValuesValuesA=deconstruct_brep_2.Faces)  # -> Keys, reverse(ValuesValuesA)
explode = Explode(Curve=list_item_3, Recursive=True)  # -> Segments, Vertices
list_item_4 = ListItem(List=sort_list.ValuesA, Index=Slider(1, range=0..1), Wrap=True)
list_item_5 = ListItem(List=sort_list_2.ValuesValuesA, Index=Slider(1, range=0..1), Wrap=True)
list_item_6 = ListItem(List=explode.Segments, Index=Slider(0, range=0..19), Wrap=True)
vector = Vector(list_item_6)
divide_curve = DivideCurve(Curve=list_item_6, Count=number_slider_4, Kinks=False)  # -> Points, Tangents, Parameters
remove_start_and_end = RemoveStartAndEnd(list=divide_curve.Points)
vector_display = VectorDisplay(Anchor=remove_start_and_end, Vector=vector)
data = Data(remove_start_and_end)
surface_closest_point = SurfaceClosestPoint(Point=data, Surface=list_item_4)  # -> Point, UVPoint, Distance
surface_closest_point_2 = SurfaceClosestPoint(Point=data, Surface=list_item_5)  # -> Point, UVPoint, Distance
evaluate_surface = EvaluateSurface(Surface=list_item_4, Point=surface_closest_point.UVPoint)  # -> Point, Normal, UDirection, VDirection, Frame
evaluate_surface_2 = EvaluateSurface(Surface=list_item_5, Point=surface_closest_point_2.UVPoint)  # -> Point, Normal, UDirection, VDirection, Frame
list_item_7 = ListItem(List=evaluate_surface.Frame, Index=0, Wrap=True)
radians = Radians(Degrees=Slider(270, range=0..1000))
radians_2 = Radians(Degrees=Slider(90, range=0..100))
rotate = Rotate(Vector=vector, Axis=evaluate_surface.Normal, Angle=radians)
rotate_2 = Rotate(Vector=vector, Axis=evaluate_surface_2.Normal, Angle=radians_2)
line_sdl = LineSDL(Start=data, Direction=rotate, Length=number_slider_2)
line_sdl_2 = LineSDL(Start=data, Direction=rotate_2, Length=number_slider_2)
join_curves = JoinCurves(Curves=[line_sdl_2, line_sdl], Preserve=False)  # -> simplify(graft(Curves))
negative = Negative(Value=number_slider)
param_viewer = ParamViewer(join_curves)
offset_curve = OffsetCurve(Curve=join_curves, Distance=[number_slider, negative], Plane=list_item_7, Corners=1)  # -> simplify(Curve)
param_viewer_2 = ParamViewer(offset_curve)
shift_paths = ShiftPaths(Data=offset_curve, Offset=-1)
panel_2 = Panel(shift_paths)
loft = Loft(Curves=shift_paths, Options={Adjust=False, Closed=False, LoftEnds=0, LoftSimp=0, LoftType=0, Rebuild=10, Refit=0.01})
explode_2 = Explode(Curve=offset_curve, Recursive=True)  # -> Segments, Vertices
cluster = Cluster_2(list=shift_paths)  # -> line_2, line_4
list_item_8 = ListItem(List=explode_2.Segments, Index=0, Wrap=True)  # -> simplify(Item1), simplify(Item)
cluster_2 = Cluster(data=list_item_8.Item, data_2=list_item_8.Item1)  # -> data_4, data_3
join_curves_2 = JoinCurves(Curves=[cluster_2.data_3, cluster.line_2], Preserve=False)
join_curves_3 = JoinCurves(Curves=[cluster_2.data_4, cluster.line_4], Preserve=False)
number_slider_7 = Slider(2, range=0..100)
fillet = Fillet(Curve=join_curves_3, Radius=number_slider_7)
fillet_2 = Fillet(Curve=join_curves_2, Radius=number_slider_7)
panel_3 = Panel(join_curves_3)
end_points = EndPoints(Curve=fillet)  # -> Start, End
line = Line(StartPoint=end_points.Start, EndPoint=end_points.End)
boundary_surfaces = BoundarySurfaces(Edges=[fillet, line])
boundary_surfaces_2 = BoundarySurfaces(Edges=[line, fillet_2])
amplitude = Amplitude(Vector=evaluate_surface.Normal, Amplitude=number_slider_3)
amplitude_2 = Amplitude(Vector=evaluate_surface_2.Normal, Amplitude=number_slider_3)
extrude = Extrude(Base=boundary_surfaces, Direction=amplitude_2)
extrude_2 = Extrude(Base=boundary_surfaces_2, Direction=amplitude)
custom_preview = CustomPreview(
    Geometry=[extrude, extrude_2],
    Material={diffuse=RGB(221, 160, 221), emission=RGB(66, 48, 66), shine=0.5, specular=RGB(255, 255, 255), transparency=0})

# ==== cluster RemoveStartAndEnd
list = ClusterInput()
number_slider = Slider(0, range=0..100)
cull_index = CullIndex(List=list, Indices=number_slider, Wrap=True)  # -> reverse(List)
cull_index_2 = CullIndex(List=cull_index, Indices=number_slider, Wrap=True)
list_2 = ClusterOutput(cull_index_2)

# ==== cluster Cluster
data = ClusterInput()
data_2 = ClusterInput()
shift_paths = ShiftPaths(Data=data_2, Offset=-1)
data_3 = ClusterOutput(shift_paths)
shift_paths_2 = ShiftPaths(Data=data, Offset=-1)
data_4 = ClusterOutput(shift_paths_2)

# ==== cluster Cluster_2
list = ClusterInput()
list_item = ListItem(List=list, Index=0, Wrap=True)  # -> Item1, Item
curve = Curve(list_item.Item1)
curve_2 = Curve(list_item.Item)
explode = Explode(Curve=curve, Recursive=True)  # -> Segments, Vertices
explode_2 = Explode(Curve=curve_2, Recursive=True)  # -> Segments, Vertices
list_item_2 = ListItem(List=explode.Vertices, Index=0, Wrap=True)  # -> Item1, Item
list_item_3 = ListItem(List=explode_2.Vertices, Index=0, Wrap=True)  # -> Item1, Item
line = Line(StartPoint=list_item_2.Item1, EndPoint=list_item_3.Item1)  # -> simplify(Line)
line_2 = ClusterOutput(line)
line_3 = Line(StartPoint=list_item_2.Item, EndPoint=list_item_3.Item)  # -> simplify(Line)
line_4 = ClusterOutput(line_3)
