# Grasshopper definition 230227_fixing_numbering_ brackets.gh (Grasshopper 1.0.7)
# plug-ins: NGon

# ---- group: Dont forget to change this when we are working with our extruded panels coz they are already retracted!!!!!!!!!!!!!
toggle = BooleanToggle(False)

# ----
knob = ControlKnob(Decimals=0, Limit=True, Maximum=50, Minimum=0, Range=10, Value=3)
# Press bake to bake!
panel = Panel("C:\Users\ahmed\OneDrive - Politecnico di Milano\ETH Zurich\HIWI\Neuramod Project\Neuramod-Support\Neuramod-Support\brackets_numbering\20230221_Brackets_panels_numbering.py")

p_n_c = PickNChoose(Pattern=toggle, Stream0=Slider(0.8, range=0..2), Stream1=Slider(0.001, range=0..0.001))

number_slider = Slider(50, range=0..200)
number_slider_2 = Slider(90, range=0..300)
# Input baked geometry to generate holding brackets
brep = Brep([<brep referenced from the Rhino model> x20])
button = Button()
# Adjust threshold and distance b/w brackets as needed
button_2 = Button()
python = GhPythonScript(breps=brep, ids=brep, threshold=number_slider, distance=number_slider_2, bake=button, bake_box=button_2)  # -> out, intersections, circs, tags, cricles, sm_edges, big_edges, p0s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; inputs breps: list of Brep, ids: list of Guid
# ---------- python: Python ----------
import Rhino.Geometry as rg
from ghpythonlib.treehelpers import list_to_tree as tree
import scriptcontext as sc
import Rhino.DocObjects as rd
import Rhino.DocObjects.ObjectAttributes as obj_att
from Rhino.RhinoDoc import ActiveDoc as doc
from Grasshopper.Kernel.GH_Convert import ToGUID as guid
import System.Collections.Generic.IEnumerable as IEnumerable
import System
import Rhino
from System import Array
from ghpythonlib.components import FilletEdge
import random as r

def GetObjectLayer(x):
    obj = doc.Objects.Find(x)
    index = obj.Attributes.LayerIndex
    layer = doc.Layers[index]
    return layer.Name

class Intersection(object):
    def __init__(self,crvs,layer,breps,layers):
        self.crvs = crvs
        self.layer = layer
        self.layers = layers
        self.breps = breps

def bake_object(obj,lay,col = 25):
    if obj is not None:
        attr = Rhino.DocObjects.ObjectAttributes()
    if lay is not None: # setting layer
        if rd.Layer.IsValidName(lay):
            layerIndex = sc.doc.Layers.Find(lay, True)
            if layerIndex < 0: # if the layer doesn't exist
                layer = rd.Layer()
                layer.Name = lay
                layer.Color = System.Drawing.Color.FromArgb(255,r.randint(0,255),0,r.randint(0,255))
                layerIndex = sc.doc.Layers.Add(layer)
            attr.LayerIndex = layerIndex
    
#    displayColor = Rhino.Display.ColorRGBA(layerIndex)
    sc.doc.Objects.AddBrep(obj, attr)

FAB_TOL = 0.15

B_TAGS = ('TO','BO','LF','RI','BA','IT','IB','IL','IR')

inter_radius = 10.0

cricles = []
sm_edges = []
big_edges = []
p0s = []
p1s = []
p01s = []
p02s = []

intersections = []
for brep0,id0 in zip(breps,ids):
    layer0 = GetObjectLayer(id0)
    for brep1,id1 in zip(breps,ids):
        layer1 = GetObjectLayer(id1)
        if (brep0 is not brep1) and (("%s-%s"%(layer0,layer1) not in [int.layer for int in intersections])) and (("%s-%s"%(layer1,layer0) not in [int.layer for int in intersections])) and (layer1 not in B_TAGS or layer0 not in B_TAGS):
#            print ("%s-%s"%(layer0,layer1)),"%s-%s"%(layer1,layer0), [int.layer for int in intersections]
            bbx = rg.Intersect.Intersection.BrepBrep(brep0,brep1,0.001)
            if bbx and len(bbx[1])>0:
                list_intersections = []
                for bx in bbx[1]:
                    if bx.GetLength() > 25:
                        list_intersections.append(bx)
                    else:
                        pass
                        #print 'small'
                interX = Intersection(list_intersections,"%s-%s"%(layer0,layer1),[brep0,brep1],[layer0,layer1])
                intersections.append(interX)

circs,tags = [],[]
for inter in intersections:
    for crv in inter.crvs:
        ts =  crv.DivideByCount(2,True)
        point,end = crv.PointAt(ts[1]),crv.PointAt(ts[2])
        if crv.GetLength()>distance*3:
            d_count = crv.GetLength()//distance
            params = crv.DivideByCount(d_count,True)
            pts = [crv.PointAt(t) for t in params[1:len(params)-1]]
        else:
            pts = [point]
        for pt in pts:
            pln = rg.Plane(pt,rg.Vector3d(end-point))
            circ = rg.Circle(rg.Plane(pt,rg.Vector3d(end-point)),inter_radius).ToNurbsCurve()
            plane = rg.Brep.CreatePlanarBreps([circ])[0]
            bpx0 = rg.Intersect.Intersection.BrepBrep(inter.breps[0],plane,0.001)
            bpx1 = rg.Intersect.Intersection.BrepBrep(inter.breps[1],plane,0.001)
            cutters = []
            if bpx0 and bpx1:
                cutters.extend([curve for curve in bpx0[1]])
                cutters.extend([curve for curve in bpx1[1]])
                cuts = plane.Split.Overloads[IEnumerable[rg.Curve], System.Double](cutters,0.001)
                
                for cut in cuts:
                    #print cut.GetArea()
                    count = 0
                    pcount = 0
                    flag = 0
                    for edge in cut.Edges:
                        count += 1
                        if edge.Degree == 1:
                            pcount += 1
                    if count>4 and cut.GetArea()>threshold and pcount>3:
                        edge_curves = [edge.EdgeCurve for edge in cut.Edges if edge.Degree == 1]
                        edge_curves.sort(key = lambda e :e.GetLength())
                        cricles.append(edge_curves)
                        edge_count = 0
                        for e in edge_curves:
                            if abs(e.GetLength() - inter_radius) < 0.1:
                                big_edge = e
                            edge_count +=1
                        small_edge = (edge_curves[3]) if (big_edge.ClosestPoint(edge_curves[1].PointAtStart,7.5)[0] or big_edge.ClosestPoint(edge_curves[1].PointAtEnd,7.5)[0]) and abs(edge_curves[1].GetLength()) > edge_curves[3].GetLength() else (edge_curves[3])
                        if edge_count<5:
                            small_edge = edge_curves[2]
                        sm_edges.append(small_edge)
                        big_edges.append(big_edge)
            #           small_edge = edge_curves[3] if edge_curves[2].GetLength()>edge_curves[3].GetLength() else edge_curves[2]
                        p0,p1 = (small_edge.PointAtStart,small_edge.PointAtEnd) if big_edge.ClosestPoint(small_edge.PointAtStart,7.5)[0] else (small_edge.PointAtEnd,small_edge.PointAtStart)
                        if big_edge.ClosestPoint(small_edge.PointAtStart,7.5)[0] and big_edge.ClosestPoint(small_edge.PointAtStart,7.5)[0]:
                            #print big_edge.ClosestPoint(small_edge.PointAtStart,7.5)[1],big_edge.ClosestPoint(small_edge.PointAtEnd,7.5)[1]
                            closest_pt_start = big_edge.PointAt(big_edge.ClosestPoint(small_edge.PointAtStart,7.5)[1])
                            start_dist = closest_pt_start.DistanceTo(small_edge.PointAtStart)
                            closest_pt_end = big_edge.PointAt(big_edge.ClosestPoint(small_edge.PointAtEnd,7.5)[1])
                            end_dist = closest_pt_end.DistanceTo(small_edge.PointAtEnd)
                            if start_dist<end_dist:
                                p0,p1 = small_edge.PointAtStart,small_edge.PointAtEnd
                            else:
                                p0,p1 = small_edge.PointAtEnd,small_edge.PointAtStart
                        pp0,pp1 = (big_edge.PointAtStart,big_edge.PointAtEnd) if small_edge.ClosestPoint(big_edge.PointAtStart,7.5)[0] else (big_edge.PointAtEnd,big_edge.PointAtStart)

                        p01s.append(pp0) 
                        p02s.append(pp1) 
                        #rebuild small and big edge for length
                        vec = rg.Vector3d(p1 - p0)
                        line = rg.Line(p0,vec,25.0 + FAB_TOL).ToNurbsCurve()
                        small_edge = line
                        vec1 = rg.Vector3d(pp1 - pp0)
                        line1 = rg.Line(pp0,vec1,25.0 + FAB_TOL).ToNurbsCurve()
                        big_edge = line1
                        big_edge.Domain = rg.Interval(0,1)
                        c_pt = big_edge.PointAt(0.5)
                        clo_pt0 = (inter.breps[0]).ClosestPoint(c_pt,1.0) 
                        clo_pt1 = (inter.breps[1]).ClosestPoint(c_pt,1.0)
                        p0s.append(clo_pt0[1])
                        p1s.append(clo_pt1[1]) 
                        guide_vec = (clo_pt0[5]) if (clo_pt0[0]) else None
                        #print inter.layer
                        #push back big_edge
                        box_type = 0
                        if not (inter.layer.Split('-')[0] in B_TAGS or inter.layer.Split('-')[1] in B_TAGS):
                            if guide_vec is None and clo_pt1[0] :
                                guide_vec = clo_pt1[5]
                            guide_vec.Unitize()
                            guide_vec *= -3.20
                            big_edge.Translate(guide_vec)
                        else:
                            box_type = 1
                        if small_edge and big_edge is not None:
                            fil = rg.Curve.CreateFilletCurves(small_edge,p0,big_edge,pp0,0,True,True,True,True,0.01)
                            #print fil
#                            rg.PolyCurve.SegmentCurve
                            if fil[0].SegmentCount<2 or min([fil[0].SegmentCurve(i).GetLength() for i in range(fil[0].SegmentCount)])<20:
                                #print 'fli'
                                fil = rg.Curve.CreateFilletCurves(small_edge,p0,big_edge, pp1,0,True,True,True,True,0.01)
                            fil = fil[0] if len(fil)==1 else None
                            off = fil.Offset(rg.Point3d((fil.PointAtEnd+fil.PointAtStart)/2),rg.Plane(fil.PointAtEnd,fil.PointAtStart,fil.PointAt(0.5)).ZAxis,3.2,0.01,0.01,False,rg.CurveOffsetCornerStyle.Sharp,rg.CurveOffsetEndStyle.Flat)
                            if not box_type: b1,b2 = rg.Extrusion.Create(off[0].ToNurbsCurve(),9.0 + FAB_TOL, True),rg.Extrusion.Create(off[0].ToNurbsCurve(),-9.0 - FAB_TOL,True)
                            else : b1,b2 = rg.Extrusion.Create(off[0].ToNurbsCurve(),15.0 + FAB_TOL, True),rg.Extrusion.Create(off[0].ToNurbsCurve(),-15.0 - FAB_TOL,True)
                            if b1 and b2 is not None:
                                x1 = b1.ToBrep()
                                x2 = b2.ToBrep()
                                bool = rg.Brep.CreateBooleanUnion([x1,x2],0.001)
                                if len(bool)==1:
                                    bool[0].MergeCoplanarFaces(0.00,0.001)
                                    bool = bool[0]
                                else:
                                    print 'Boolean not created, check breps'
                            else:
                                print 'Bad Offset Curve, Extrusion not created.'
                            fillet_indices = []
                            
                            for edge in bool.Edges:
                                if abs(edge.EdgeCurve.GetLength() - 3.2) < 0.5:
                                    num =  edge.EdgeIndex
                                    fillet_indices.append(num)
                            indices = fillet_indices
                            bbe = rg.Brep.CreateFilletEdges(bool,indices,[2.0 for _ in range(len(indices))],[2.0 for _ in range(len(indices))],rg.BlendType.Fillet,rg.RailType.RollingBall,0.0001)
                        bbe = bbe[0]
                        circs.append([small_edge,big_edge,cut])
                        circs.append(bbe)
                        tags.append(inter.layer)
    
sc.doc = doc

for tag in tags:
    if tag.Split('-')[0] in B_TAGS or tag.Split('-')[1] in B_TAGS:
        pass

if bake:
    for part,tag in zip(circs,tags):
        bake_object(part,tag)

if bake_box:
    for part,tag in zip(circs,tags):
        if tag.Split('-')[0] in B_TAGS or tag.Split('-')[1] in B_TAGS:
            bake_object(part,tag)
    
sc.doc = ghdoc

intersections = intersections
circs = tree(circs)
# ---------- end python ----------
python_2 = GhPythonScript(inter=python.intersections)  # -> out, a, b; inputs inter: list
# ---------- python_2: Python ----------
import Rhino.Geometry as rg

a,b= [],[]
for int in inter:
    a.extend(int.crvs)
    b.append(int.layer)
# ---------- end python_2 ----------

brep_2 = Brep([<brep referenced from the Rhino model> x12])
item = ListItem(List=brep, Index=knob, Wrap=True)
data = Data(item)
data_2 = Data(python.big_edges)
data_3 = Data(python.sm_edges)
data_4 = Data(python.p01s)
data_5 = Data(python.p02s)
data_6 = Data(python.p1s)
data_7 = Data(python.p0s)
move_text_distance2 = Slider(30, range=1..50)
python_3 = GhPythonScript(x=python.cricles)  # -> out, a
# ---------- python_3: Python ----------
a = x
# ---------- end python_3 ----------
data_8 = Data(python.sm_edges)
box_number = Slider(0, range=0..33)
data_9 = Data(python.cricles)
Z = UnitZ(Factor=Slider(1083, range=100..20000))
python_4 = GhPythonScript(breps=brep, ids=brep, threshold=number_slider, distance=number_slider_2, bake=button, bake_box=button_2)  # -> out, intersections, circs, tags; inputs breps: list of Brep, ids: list of Guid
# ---------- python_4: Python ----------
import Rhino.Geometry as rg
from ghpythonlib.treehelpers import list_to_tree as tree
import scriptcontext as sc
import Rhino.DocObjects as rd
import Rhino.DocObjects.ObjectAttributes as obj_att
from Rhino.RhinoDoc import ActiveDoc as doc
from Grasshopper.Kernel.GH_Convert import ToGUID as guid
import System.Collections.Generic.IEnumerable as IEnumerable
import System
import Rhino
from System import Array
from ghpythonlib.components import FilletEdge
import random as r

def GetObjectLayer(x):
    obj = doc.Objects.Find(x)
    index = obj.Attributes.LayerIndex
    layer = doc.Layers[index]
    return layer.Name

class Intersection(object):
    def __init__(self,crvs,layer,breps,layers):
        self.crvs = crvs
        self.layer = layer
        self.layers = layers
        self.breps = breps

def bake_object(obj,lay,col = 25):
    if obj is not None:
        attr = Rhino.DocObjects.ObjectAttributes()
    if lay is not None: # setting layer
        if rd.Layer.IsValidName(lay):
            layerIndex = sc.doc.Layers.Find(lay, True)
            if layerIndex < 0: # if the layer doesn't exist
                layer = rd.Layer()
                layer.Name = lay
                layer.Color = System.Drawing.Color.FromArgb(255,r.randint(0,255),0,r.randint(0,255))
                layerIndex = sc.doc.Layers.Add(layer)
            attr.LayerIndex = layerIndex
    
#    displayColor = Rhino.Display.ColorRGBA(layerIndex)
    sc.doc.Objects.AddBrep(obj, attr)

FAB_TOL = 0.15

B_TAGS = ('TO','BO','LF','RI','BA','IT','IB','IL','IR')

inter_radius = 10.0

intersections = []
for brep0,id0 in zip(breps,ids):
    layer0 = GetObjectLayer(id0)
    for brep1,id1 in zip(breps,ids):
        layer1 = GetObjectLayer(id1)
        if (brep0 is not brep1) and (("%s-%s"%(layer0,layer1) not in [int.layer for int in intersections])) and (("%s-%s"%(layer1,layer0) not in [int.layer for int in intersections])) and (layer1 not in B_TAGS or layer0 not in B_TAGS):
#            print ("%s-%s"%(layer0,layer1)),"%s-%s"%(layer1,layer0), [int.layer for int in intersections]
            bbx = rg.Intersect.Intersection.BrepBrep(brep0,brep1,0.001)
            if bbx and len(bbx[1])>0:
                list_intersections = []
                for bx in bbx[1]:
                    if bx.GetLength() > 25:
                        list_intersections.append(bx)
                    else:
                        print 'small'
                interX = Intersection(list_intersections,"%s-%s"%(layer0,layer1),[brep0,brep1],[layer0,layer1])
                intersections.append(interX)

circs,tags = [],[]
for inter in intersections:
    for crv in inter.crvs:
        ts =  crv.DivideByCount(2,True)
        point,end = crv.PointAt(ts[1]),crv.PointAt(ts[2])
        if crv.GetLength()>distance*3:
            d_count = crv.GetLength()//distance
            params = crv.DivideByCount(d_count,True)
            pts = [crv.PointAt(t) for t in params[1:len(params)-1]]
        else:
            pts = [point]
        for pt in pts:
            pln = rg.Plane(pt,rg.Vector3d(end-point))
            circ = rg.Circle(rg.Plane(pt,rg.Vector3d(end-point)),inter_radius).ToNurbsCurve()
            plane = rg.Brep.CreatePlanarBreps([circ])[0]
            bpx0 = rg.Intersect.Intersection.BrepBrep(inter.breps[0],plane,0.001)
            bpx1 = rg.Intersect.Intersection.BrepBrep(inter.breps[1],plane,0.001)
            cutters = []
            if bpx0 and bpx1:
                cutters.extend([curve for curve in bpx0[1]])
                cutters.extend([curve for curve in bpx1[1]])
                cuts = plane.Split.Overloads[IEnumerable[rg.Curve], System.Double](cutters,0.001)
                for cut in cuts:
                    count = 0
                    pcount = 0
                    flag = 0
                    for edge in cut.Edges:
                        count += 1
                        if edge.Degree == 1:
                            pcount += 1
                    if count>4 and cut.GetArea()>threshold and pcount>3:
                        edge_curves = [edge.EdgeCurve for edge in cut.Edges if edge.Degree == 1]
                        edge_curves.sort(key = lambda e :e.GetLength())
                        edge_count = 0
                        for e in edge_curves:
                            if abs(e.GetLength() - inter_radius) < 0.1:
                                big_edge = e
                            edge_count +=1
                        small_edge = (edge_curves[3]) if (big_edge.ClosestPoint(edge_curves[1].PointAtStart,7.5)[0] or big_edge.ClosestPoint(edge_curves[1].PointAtEnd,7.5)[0]) and abs(edge_curves[1].GetLength()) > edge_curves[3].GetLength() else (edge_curves[3])
                        if edge_count<5:
                            small_edge = edge_curves[2]
            #           small_edge = edge_curves[3] if edge_curves[2].GetLength()>edge_curves[3].GetLength() else edge_curves[2]
                        p0,p1 = (small_edge.PointAtStart,small_edge.PointAtEnd) if big_edge.ClosestPoint(small_edge.PointAtStart,7.5)[0] else (small_edge.PointAtEnd,small_edge.PointAtStart)
                        if big_edge.ClosestPoint(small_edge.PointAtStart,7.5)[0] and big_edge.ClosestPoint(small_edge.PointAtStart,7.5)[0]:
                            print big_edge.ClosestPoint(small_edge.PointAtStart,7.5)[1],big_edge.ClosestPoint(small_edge.PointAtEnd,7.5)[1]
                            closest_pt_start = big_edge.PointAt(big_edge.ClosestPoint(small_edge.PointAtStart,7.5)[1])
                            start_dist = closest_pt_start.DistanceTo(small_edge.PointAtStart)
                            closest_pt_end = big_edge.PointAt(big_edge.ClosestPoint(small_edge.PointAtEnd,7.5)[1])
                            end_dist = closest_pt_end.DistanceTo(small_edge.PointAtEnd)
                            if start_dist<end_dist:
                                p0,p1 = small_edge.PointAtStart,small_edge.PointAtEnd
                            else:
                                p0,p1 = small_edge.PointAtEnd,small_edge.PointAtStart
                        pp0,pp1 = (big_edge.PointAtStart,big_edge.PointAtEnd) if small_edge.ClosestPoint(big_edge.PointAtStart,7.5)[0] else (big_edge.PointAtEnd,big_edge.PointAtStart)
                        #rebuild small and big edge for length
                        vec = rg.Vector3d(p1 - p0)
                        line = rg.Line(p0,vec,25.0 + FAB_TOL).ToNurbsCurve()
                        small_edge = line
                        vec1 = rg.Vector3d(pp1 - pp0)
                        line1 = rg.Line(pp0,vec1,25.0 + FAB_TOL).ToNurbsCurve()
                        big_edge = line1
                        big_edge.Domain = rg.Interval(0,1)
                        c_pt = big_edge.PointAt(0.5)
                        clo_pt0 = (inter.breps[0]).ClosestPoint(c_pt,1.0) 
                        clo_pt1 = (inter.breps[1]).ClosestPoint(c_pt,1.0)
                        guide_vec = (clo_pt0[5]) if (clo_pt0[0]) else None
                        print inter.layer
                        #push back big_edge
                        box_type = 0
                        if not (inter.layer.Split('-')[0] in B_TAGS or inter.layer.Split('-')[1] in B_TAGS):
                            if guide_vec is None and clo_pt1[0] :
                                guide_vec = clo_pt1[5]
                            guide_vec.Unitize()
                            guide_vec *= -3.20
                            big_edge.Translate(guide_vec)
                        else:
                            box_type = 1
                        if small_edge and big_edge is not None:
                            fil = rg.Curve.CreateFilletCurves(small_edge,p0,big_edge,pp0,0,True,True,True,True,0.01)
                            print fil
#                            rg.PolyCurve.SegmentCurve
                            if fil[0].SegmentCount<2 or min([fil[0].SegmentCurve(i).GetLength() for i in range(fil[0].SegmentCount)])<20:
                                print 'fli'
                                fil = rg.Curve.CreateFilletCurves(small_edge,p0,big_edge, pp1,0,True,True,True,True,0.01)
                            fil = fil[0] if len(fil)==1 else None
                            off = fil.Offset(rg.Point3d((fil.PointAtEnd+fil.PointAtStart)/2),rg.Plane(fil.PointAtEnd,fil.PointAtStart,fil.PointAt(0.5)).ZAxis,3.2,0.01,0.01,False,rg.CurveOffsetCornerStyle.Sharp,rg.CurveOffsetEndStyle.Flat)
                            if not box_type: b1,b2 = rg.Extrusion.Create(off[0].ToNurbsCurve(),9.0 + FAB_TOL, True),rg.Extrusion.Create(off[0].ToNurbsCurve(),-9.0 - FAB_TOL,True)
                            else : b1,b2 = rg.Extrusion.Create(off[0].ToNurbsCurve(),15.0 + FAB_TOL, True),rg.Extrusion.Create(off[0].ToNurbsCurve(),-15.0 - FAB_TOL,True)
                            if b1 and b2 is not None:
                                x1 = b1.ToBrep()
                                x2 = b2.ToBrep()
                                bool = rg.Brep.CreateBooleanUnion([x1,x2],0.001)
                                if len(bool)==1:
                                    bool[0].MergeCoplanarFaces(0.00,0.001)
                                    bool = bool[0]
                                else:
                                    print 'Boolean not created, check breps'
                            else:
                                print 'Bad Offset Curve, Extrusion not created.'
                            fillet_indices = []
                            
                            for edge in bool.Edges:
                                if abs(edge.EdgeCurve.GetLength() - 3.2) < 0.5:
                                    num =  edge.EdgeIndex
                                    fillet_indices.append(num)
                            indices = fillet_indices
                            bbe = rg.Brep.CreateFilletEdges(bool,indices,[2.0 for _ in range(len(indices))],[2.0 for _ in range(len(indices))],rg.BlendType.Fillet,rg.RailType.RollingBall,0.0001)
                        bbe = bbe[0]
                        circs.append([small_edge,big_edge,cut])
                        circs.append(bbe)
                        tags.append(inter.layer)
    
sc.doc = doc

for tag in tags:
    if tag.Split('-')[0] in B_TAGS or tag.Split('-')[1] in B_TAGS:
        pass

if bake:
    for part,tag in zip(circs,tags):
        bake_object(part,tag)

if bake_box:
    for part,tag in zip(circs,tags):
        if tag.Split('-')[0] in B_TAGS or tag.Split('-')[1] in B_TAGS:
            bake_object(part,tag)
    
sc.doc = ghdoc

intersections = intersections
circs = tree(circs)
# ---------- end python_4 ----------
read_file = ReadFile(File=panel, PerLineParse=False)
ln = Line(StartPoint=python.p0s, EndPoint=python.p1s)
data_10 = Data(python_2.a)
# Remaining
# - Solve the bug in creating the proper planes
# - creating a function that loops through the panel number based on its number or id and remove the part of the bracket from it !! (check if ananya had already done something like this)
# - Adjust the writing of the code # to understand the whole process.
toggle_2 = BooleanToggle(True)
ln_2 = Line(StartPoint=python.p01s, EndPoint=python.p02s)
crv = Curve(<curve referenced from the Rhino model>)
move = Move(Geometry=python_3.a, Motion=Z)  # -> Geometry, Transform
item_2 = ListItem(List=brep, Index=0, Wrap=True)  # -> Item, Item1, Item2, Item3, Item4, Item5, Item6, Item7
ghpython_script = GhPythonScript(
    Code=read_file,
    Breps=brep_2,
    Ids=brep_2,
    Threshold=number_slider,
    Distance=number_slider_2,
    Bake=button,
    Bake_box=button_2,
    Inter_tol_breps=p_n_c,
    Dup_lines_tol=Slider(2.686, range=0..5),
    Lines_list=crv,
    Box_number=box_number,
    Move_text_distance1=Slider(25, range=1..50),
    Move_text_distance2=move_text_distance2,
    Get_panels=toggle_2)  # -> Out, Intersections, Circs, Tags, Lines, port, Debgging, port_2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
panel_2 = Panel(p_n_c)
data_11 = Data(item_2.Item6)
data_12 = Data(item_2.Item)
data_13 = Data(ghpython_script.Trimmed_breps)
python_5 = GhPythonScript(inter=ghpython_script.Intersections)  # -> out, a, b; inputs inter: list; same code as python_2

X = UnitX(Factor=reverse(Slider(7302, range=100..10000)))
move_2 = Move(Geometry=ghpython_script.All_panels, Motion=reverse(X))  # -> Geometry, Transform

data_14 = Data(simplify(flatten(ghpython_script.Circs)))
panel_3 = Panel(ghpython_script.Out)
null = NullItem(Item=data_14)  # -> NullFlags, InvalidFlags, Description
dispatch = Dispatch(List=data_14, DispatchPattern=null.NullFlags)  # -> ListA, RealBracket

knob_2 = ControlKnob(Decimals=0, Limit=True, Maximum=500, Minimum=0, Range=10, Value=4)
python_6 = GhPythonScript()  # -> out, simplify(a); same code as python_3
path = ConstructPath(Indices=knob_2)
branch = TreeBranch(Tree=python_6.a, Path=path, MaintainPaths=True)

pln = Plane(ghpython_script.Planes_txt)
bool = Boolean(False)
txt = Text(ghpython_script.Tag_txt)
text = Text(Location=pln, Text=txt, Size=Slider(2, range=0..50), Bold=bool, HorizontalAlignment=0, VerticalAlignment=0)

# ---- group: Real Brackets !!!
data_15 = Data(dispatch.RealBracket)

# ----
python_7 = GhPythonScript()  # -> out, simplify(flatten(a)); same code as python_3
python_8 = GhPythonScript(x=python_7.a)  # -> out, simplify(flatten(a)); same code as python_3
