# Grasshopper definition 230221_fixing_numbering_ brackets.gh (Grasshopper 1.0.7)

crv = Curve(<curve referenced from the Rhino model>)
knob = ControlKnob(Decimals=0, Limit=True, Maximum=50, Minimum=0, Range=10, Value=3)
panel = Panel("C:\Users\ahmed\OneDrive - Politecnico di Milano\ETH Zurich\HIWI\Neuramod Project\Neuramod-Support\Neuramod-Support\brackets_numbering\20230221_Brackets_panels_numbering.py")

number_slider = Slider(90, range=0..300)
number_slider_2 = Slider(50, range=0..200)
# Input baked geometry to generate holding brackets
brep = Brep([<brep referenced from the Rhino model> x20])
button = Button()
button_2 = Button()
python = GhPythonScript(breps=brep, ids=brep, threshold=number_slider_2, distance=number_slider, bake=button, bake_box=button_2)  # -> out, intersections, circs, tags, cricles, sm_edges, big_edges, p0s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; inputs breps: list of Brep, ids: list of Guid
# ---------- python: Python ----------
import Rhino.Geometry as rg
from ghpythonlib.treehelpers import list_to_tree as tree
import scriptcontext as sc
import Rhino.DocObjects as rd
import Rhino.DocObjects.ObjectAttributes as obj_att
from Rhino.RhinoDoc import ActiveDoc as doc
from Grasshopper.Kernel.GH_Convert import ToGUID as guid
import System.Collections.Generic.IEnumerable as IEnumerable
import System
import Rhino
from System import Array
from ghpythonlib.components import FilletEdge
import random as r

def GetObjectLayer(x):
    obj = doc.Objects.Find(x)
    index = obj.Attributes.LayerIndex
    layer = doc.Layers[index]
    return layer.Name

class Intersection(object):
    def __init__(self,crvs,layer,breps,layers):
        self.crvs = crvs
        self.layer = layer
        self.layers = layers
        self.breps = breps

def bake_object(obj,lay,col = 25):
    if obj is not None:
        attr = Rhino.DocObjects.ObjectAttributes()
    if lay is not None: # setting layer
        if rd.Layer.IsValidName(lay):
            layerIndex = sc.doc.Layers.Find(lay, True)
            if layerIndex < 0: # if the layer doesn't exist
                layer = rd.Layer()
                layer.Name = lay
                layer.Color = System.Drawing.Color.FromArgb(255,r.randint(0,255),0,r.randint(0,255))
                layerIndex = sc.doc.Layers.Add(layer)
            attr.LayerIndex = layerIndex
    
#    displayColor = Rhino.Display.ColorRGBA(layerIndex)
    sc.doc.Objects.AddBrep(obj, attr)

FAB_TOL = 0.15

B_TAGS = ('TO','BO','LF','RI','BA','IT','IB','IL','IR')

inter_radius = 10.0

cricles = []
sm_edges = []
big_edges = []
p0s = []
p1s = []
p01s = []
p02s = []

intersections = []
for brep0,id0 in zip(breps,ids):
    layer0 = GetObjectLayer(id0)
    for brep1,id1 in zip(breps,ids):
        layer1 = GetObjectLayer(id1)
        if (brep0 is not brep1) and (("%s-%s"%(layer0,layer1) not in [int.layer for int in intersections])) and (("%s-%s"%(layer1,layer0) not in [int.layer for int in intersections])) and (layer1 not in B_TAGS or layer0 not in B_TAGS):
#            print ("%s-%s"%(layer0,layer1)),"%s-%s"%(layer1,layer0), [int.layer for int in intersections]
            bbx = rg.Intersect.Intersection.BrepBrep(brep0,brep1,0.001)
            if bbx and len(bbx[1])>0:
                list_intersections = []
                for bx in bbx[1]:
                    if bx.GetLength() > 25:
                        list_intersections.append(bx)
                    else:
                        pass
                        #print 'small'
                interX = Intersection(list_intersections,"%s-%s"%(layer0,layer1),[brep0,brep1],[layer0,layer1])
                intersections.append(interX)

circs,tags = [],[]
for inter in intersections:
    for crv in inter.crvs:
        ts =  crv.DivideByCount(2,True)
        point,end = crv.PointAt(ts[1]),crv.PointAt(ts[2])
        if crv.GetLength()>distance*3:
            d_count = crv.GetLength()//distance
            params = crv.DivideByCount(d_count,True)
            pts = [crv.PointAt(t) for t in params[1:len(params)-1]]
        else:
            pts = [point]
        for pt in pts:
            pln = rg.Plane(pt,rg.Vector3d(end-point))
            circ = rg.Circle(rg.Plane(pt,rg.Vector3d(end-point)),inter_radius).ToNurbsCurve()
            plane = rg.Brep.CreatePlanarBreps([circ])[0]
            bpx0 = rg.Intersect.Intersection.BrepBrep(inter.breps[0],plane,0.001)
            bpx1 = rg.Intersect.Intersection.BrepBrep(inter.breps[1],plane,0.001)
            cutters = []
            if bpx0 and bpx1:
                cutters.extend([curve for curve in bpx0[1]])
                cutters.extend([curve for curve in bpx1[1]])
                cuts = plane.Split.Overloads[IEnumerable[rg.Curve], System.Double](cutters,0.001)
                
                for cut in cuts:
                    #print cut.GetArea()
                    count = 0
                    pcount = 0
                    flag = 0
                    for edge in cut.Edges:
                        count += 1
                        if edge.Degree == 1:
                            pcount += 1
                    if count>4 and cut.GetArea()>threshold and pcount>3:
                        edge_curves = [edge.EdgeCurve for edge in cut.Edges if edge.Degree == 1]
                        edge_curves.sort(key = lambda e :e.GetLength())
                        cricles.append(edge_curves)
                        edge_count = 0
                        for e in edge_curves:
                            if abs(e.GetLength() - inter_radius) < 0.1:
                                big_edge = e
                            edge_count +=1
                        small_edge = (edge_curves[3]) if (big_edge.ClosestPoint(edge_curves[1].PointAtStart,7.5)[0] or big_edge.ClosestPoint(edge_curves[1].PointAtEnd,7.5)[0]) and abs(edge_curves[1].GetLength()) > edge_curves[3].GetLength() else (edge_curves[3])
                        if edge_count<5:
                            small_edge = edge_curves[2]
                        sm_edges.append(small_edge)
                        big_edges.append(big_edge)
            #           small_edge = edge_curves[3] if edge_curves[2].GetLength()>edge_curves[3].GetLength() else edge_curves[2]
                        p0,p1 = (small_edge.PointAtStart,small_edge.PointAtEnd) if big_edge.ClosestPoint(small_edge.PointAtStart,7.5)[0] else (small_edge.PointAtEnd,small_edge.PointAtStart)
                        if big_edge.ClosestPoint(small_edge.PointAtStart,7.5)[0] and big_edge.ClosestPoint(small_edge.PointAtStart,7.5)[0]:
                            #print big_edge.ClosestPoint(small_edge.PointAtStart,7.5)[1],big_edge.ClosestPoint(small_edge.PointAtEnd,7.5)[1]
                            closest_pt_start = big_edge.PointAt(big_edge.ClosestPoint(small_edge.PointAtStart,7.5)[1])
                            start_dist = closest_pt_start.DistanceTo(small_edge.PointAtStart)
                            closest_pt_end = big_edge.PointAt(big_edge.ClosestPoint(small_edge.PointAtEnd,7.5)[1])
                            end_dist = closest_pt_end.DistanceTo(small_edge.PointAtEnd)
                            if start_dist<end_dist:
                                p0,p1 = small_edge.PointAtStart,small_edge.PointAtEnd
                            else:
                                p0,p1 = small_edge.PointAtEnd,small_edge.PointAtStart
                        pp0,pp1 = (big_edge.PointAtStart,big_edge.PointAtEnd) if small_edge.ClosestPoint(big_edge.PointAtStart,7.5)[0] else (big_edge.PointAtEnd,big_edge.PointAtStart)
                        p0s.append(p0)
                        p1s.append(p1) 
                        p01s.append(pp0) 
                        p02s.append(pp1) 
                        #rebuild small and big edge for length
                        vec = rg.Vector3d(p1 - p0)
                        line = rg.Line(p0,vec,25.0 + FAB_TOL).ToNurbsCurve()
                        small_edge = line
                        vec1 = rg.Vector3d(pp1 - pp0)
                        line1 = rg.Line(pp0,vec1,25.0 + FAB_TOL).ToNurbsCurve()
                        big_edge = line1
                        big_edge.Domain = rg.Interval(0,1)
                        c_pt = big_edge.PointAt(0.5)
                        clo_pt0 = (inter.breps[0]).ClosestPoint(c_pt,1.0) 
                        clo_pt1 = (inter.breps[1]).ClosestPoint(c_pt,1.0)
                        guide_vec = (clo_pt0[5]) if (clo_pt0[0]) else None
                        #print inter.layer
                        #push back big_edge
                        box_type = 0
                        if not (inter.layer.Split('-')[0] in B_TAGS or inter.layer.Split('-')[1] in B_TAGS):
                            if guide_vec is None and clo_pt1[0] :
                                guide_vec = clo_pt1[5]
                            guide_vec.Unitize()
                            guide_vec *= -3.20
                            big_edge.Translate(guide_vec)
                        else:
                            box_type = 1
                        if small_edge and big_edge is not None:
                            fil = rg.Curve.CreateFilletCurves(small_edge,p0,big_edge,pp0,0,True,True,True,True,0.01)
                            #print fil
#                            rg.PolyCurve.SegmentCurve
                            if fil[0].SegmentCount<2 or min([fil[0].SegmentCurve(i).GetLength() for i in range(fil[0].SegmentCount)])<20:
                                #print 'fli'
                                fil = rg.Curve.CreateFilletCurves(small_edge,p0,big_edge, pp1,0,True,True,True,True,0.01)
                            fil = fil[0] if len(fil)==1 else None
                            off = fil.Offset(rg.Point3d((fil.PointAtEnd+fil.PointAtStart)/2),rg.Plane(fil.PointAtEnd,fil.PointAtStart,fil.PointAt(0.5)).ZAxis,3.2,0.01,0.01,False,rg.CurveOffsetCornerStyle.Sharp,rg.CurveOffsetEndStyle.Flat)
                            if not box_type: b1,b2 = rg.Extrusion.Create(off[0].ToNurbsCurve(),9.0 + FAB_TOL, True),rg.Extrusion.Create(off[0].ToNurbsCurve(),-9.0 - FAB_TOL,True)
                            else : b1,b2 = rg.Extrusion.Create(off[0].ToNurbsCurve(),15.0 + FAB_TOL, True),rg.Extrusion.Create(off[0].ToNurbsCurve(),-15.0 - FAB_TOL,True)
                            if b1 and b2 is not None:
                                x1 = b1.ToBrep()
                                x2 = b2.ToBrep()
                                bool = rg.Brep.CreateBooleanUnion([x1,x2],0.001)
                                if len(bool)==1:
                                    bool[0].MergeCoplanarFaces(0.00,0.001)
                                    bool = bool[0]
                                else:
                                    print 'Boolean not created, check breps'
                            else:
                                print 'Bad Offset Curve, Extrusion not created.'
                            fillet_indices = []
                            
                            for edge in bool.Edges:
                                if abs(edge.EdgeCurve.GetLength() - 3.2) < 0.5:
                                    num =  edge.EdgeIndex
                                    fillet_indices.append(num)
                            indices = fillet_indices
                            bbe = rg.Brep.CreateFilletEdges(bool,indices,[2.0 for _ in range(len(indices))],[2.0 for _ in range(len(indices))],rg.BlendType.Fillet,rg.RailType.RollingBall,0.0001)
                        bbe = bbe[0]
                        circs.append([small_edge,big_edge,cut])
                        circs.append(bbe)
                        tags.append(inter.layer)
    
sc.doc = doc

for tag in tags:
    if tag.Split('-')[0] in B_TAGS or tag.Split('-')[1] in B_TAGS:
        pass

if bake:
    for part,tag in zip(circs,tags):
        bake_object(part,tag)

if bake_box:
    for part,tag in zip(circs,tags):
        if tag.Split('-')[0] in B_TAGS or tag.Split('-')[1] in B_TAGS:
            bake_object(part,tag)
    
sc.doc = ghdoc

intersections = intersections
circs = tree(circs)
# ---------- end python ----------
python_2 = GhPythonScript(inter=python.intersections)  # -> out, a, b; inputs inter: list
# ---------- python_2: Python ----------
import Rhino.Geometry as rg

a,b= [],[]
for int in inter:
    a.extend(int.crvs)
    b.append(int.layer)
# ---------- end python_2 ----------

brep_2 = Brep([<brep referenced from the Rhino model> x12])
item = ListItem(List=brep, Index=knob, Wrap=True)

# ---- group: Dont forget to change this when we are working with our extruded panels coz they are already retracted!!!!!!!!!!!!!
toggle = BooleanToggle(False)

# ----
data = Data(item)
data_2 = Data(python.p0s)
data_3 = Data(python.big_edges)
data_4 = Data(python.sm_edges)
data_5 = Data(python.p01s)
data_6 = Data(python.p02s)
data_7 = Data(python.p1s)
python_3 = GhPythonScript(x=python.cricles)  # -> out, a
# ---------- python_3: Python ----------
a = x
# ---------- end python_3 ----------
data_8 = Data(python.sm_edges)
number_slider_3 = Slider(2.686, range=0..5)
p_n_c = PickNChoose(Pattern=toggle, Stream0=Slider(0.8, range=0..2), Stream1=Slider(0.001, range=0..0.001))
# Adjust threshold and distance b/w brackets as needed
# Press bake to bake!
ghpython_script = GhPythonScript(
    breps=brep_2,
    ids=brep_2,
    threshold=number_slider_2,
    distance=number_slider,
    bake=button,
    bake_box=button_2,
    inter_tol_breps=p_n_c,
    dup_lines_tol=number_slider_3,
    lines_list=crv)  # -> out, intersections, circs, tags, circles, lines; inputs breps: list of Brep, ids: list of Guid, lines_list: Curve
# ---------- ghpython_script: Python ----------
import Rhino.Geometry as rg
from ghpythonlib.treehelpers import list_to_tree as tree
import scriptcontext as sc
import Rhino.DocObjects as rd
import Rhino.DocObjects.ObjectAttributes as obj_att
from Rhino.RhinoDoc import ActiveDoc as doc
from Grasshopper.Kernel.GH_Convert import ToGUID as guid
import System.Collections.Generic.IEnumerable as IEnumerable
import System
import Rhino
from System import Array
from ghpythonlib.components import FilletEdge
import random as r

def GetObjectLayer(x):
    obj = doc.Objects.Find(x)
    index = obj.Attributes.LayerIndex
    layer = doc.Layers[index]
    return layer.Name

def remove_duplicate_lines_from_polycurve(polycurve, tolerance):
    """Removes the duplicates of intersection lines that may occur when intersecting the 2 breps
    """
    # create a list to store the unique lines
    lines = []
    for curve in polycurve.Explode():
        #print("curve is linear : {0}".format(curve.IsLinear()))
        if curve.GetLength() > 20:
            curve.Domain = rg.Interval(0,1)
            lines.append(curve)

    duplicate_lines = []
    unique_lines = []
    
    for i, uni_l in enumerate(lines):
        #print (type(uni_l))
        for j, line in enumerate(lines[i+1:]):
            #check if we can get line out of it:         
            # iterate over the input lines
            #if distance is less than tolerance and direction is same or opposite
            #and the length almost equal then skip and print duplicate line
            len_uni_l = uni_l.GetLength()
            len_line = line.GetLength()
            dir_uni_l = uni_l.TangentAt(0.5)
            dir_line = line.TangentAt(0.5)
            #dir_uni_l.Unitize()
            #dir_line.Unitize()
            distance = uni_l.PointAt(0.5).DistanceTo(line.PointAt(0.5))
            #print("distance is {0}".format(distance))
            #print(rg.NurbsCurve.IsDuplicate(uni_l, line, True, tolerance))
            if (len_uni_l / len_line > 0.90 and len_uni_l / len_line < 1.1) and abs(dir_line * dir_uni_l) > 0.95 and distance < tolerance:
            #if rg.NurbsCurve.IsDuplicate(uni_l, line, True, tolerance):
                #print("lines are too close")
                duplicate_lines.append(line)

            
    for uni_l in lines:
        if uni_l not in duplicate_lines:
            unique_lines.append(uni_l) 

    return unique_lines

def remove_duplicate_lines(lines, tolerance):
    """Removes the duplicates of intersection lines that may occur when intersecting the 2 breps
    """
    # create a list to store the unique lines
    duplicate_lines = []
    unique_lines = []
    
    for line in lines:
        line.Domain = rg.Interval(0,1)

    for i, uni_l in enumerate(lines):
        for j, line in enumerate(lines[i+1:]):
            #check if we can get line out of it:         
            # iterate over the input lines
            #if distance is less than tolerance and direction is same or opposite
            #and the length almost equal then skip and print duplicate line
            len_uni_l = uni_l.GetLength()
            len_line = line.GetLength()
            dir_uni_l = uni_l.TangentAt(0.5)
            dir_line = line.TangentAt(0.5)
            distance = uni_l.PointAt(0.5).DistanceTo(line.PointAt(0.5))

            if (len_uni_l / len_line > 0.90 and len_uni_l / len_line < 1.1) and abs(dir_line * dir_uni_l) > 0.95 and distance < tolerance:
                print("lines are too close")
                duplicate_lines.append(line)
            
    for uni_l in lines:
        if uni_l not in duplicate_lines:
            unique_lines.append(uni_l) 

    return unique_lines

class Intersection(object):
    """Determines all data of intersection between layer and another layer 
        which means between one brep and another brep. 
        crvs: intersection lines
        Layer: name of the 2 layers in rhino string
        breps: actual breps list 
        layers: actual layers list         
    """
    def __init__(self,crvs,layer,breps,layers):
        self.crvs = crvs
        self.layer = layer
        self.layers = layers
        self.breps = breps

def bake_object(obj,lay,col = 25):
    if obj is not None:
        attr = Rhino.DocObjects.ObjectAttributes()
    if lay is not None: # setting layer
        if rd.Layer.IsValidName(lay):
            layerIndex = sc.doc.Layers.Find(lay, True)
            if layerIndex < 0: # if the layer doesn't exist
                layer = rd.Layer()
                layer.Name = lay
                layer.Color = System.Drawing.Color.FromArgb(255,r.randint(0,255),0,r.randint(0,255))
                layerIndex = sc.doc.Layers.Add(layer)
            attr.LayerIndex = layerIndex
    
#    displayColor = Rhino.Display.ColorRGBA(layerIndex)
    sc.doc.Objects.AddBrep(obj, attr)

FAB_TOL = 0.15

B_TAGS = ('TO','BO','LF','RI','BA','IT','IB','IL','IR')

inter_radius = 10.0


lines =  remove_duplicate_lines_from_polycurve(lines_list, dup_lines_tol)


intersections = []
#get the intersection curves (line likes) between each brep and the ther other 
for brep0,id0 in zip(breps,ids):
    layer0 = GetObjectLayer(id0) #layer0 is the name of the layer of the baked brep in the actual rhino file
    #print("layer 0 is {0}".format(layer0))
    for brep1,id1 in zip(breps,ids):
        layer1 = GetObjectLayer(id1)
        #print("layer 1 is {0}".format(layer1))
        if (brep0 is not brep1) and (("%s-%s"%(layer0,layer1) not in [int.layer for int in intersections])) and (("%s-%s"%(layer1,layer0) not in [int.layer for int in intersections])) and (layer1 not in B_TAGS or layer0 not in B_TAGS):
            #print ("%s-%s"%(layer0,layer1)),"%s-%s"%(layer1,layer0), [int.layer for int in intersections]

            bbx = rg.Intersect.Intersection.BrepBrep(brep0,brep1,inter_tol_breps)
            if bbx and len(bbx[1])>0:
                list_intersections = []
                for bx in bbx[1]:
                    if bx.GetLength() > 25:
                        #we need to do somthing to prevent duplicates
                        if bx.IsLinear():
                            list_intersections.append(bx)
                        else:
                            output_line = remove_duplicate_lines_from_polycurve(bx,dup_lines_tol)
                            #print("output lines count is {}")
                            if len(output_line) == 1:
                                list_intersections.append(output_line[0])
                            else:
                                print ("we have a problem !!!")

                    else:
                        print ('small')
                list_intersections = remove_duplicate_lines(list_intersections, dup_lines_tol)
                interX = Intersection(list_intersections,"%s-%s"%(layer0,layer1),[brep0,brep1],[layer0,layer1])
                intersections.append(interX)
circles = []
circs,tags = [],[]
for inter in intersections:
    for crv in inter.crvs:
        #checks if curve is long enough to put more than 1 bracket or can only fit no more than 1 bracket only
        #new!! setting domain to be in between 0 and 1
        crv.Domain = rg.Interval(0,1)
        ts =  crv.DivideByCount(2,True)
        #print("domain is {0} and {1}".format(ts[1], ts[2]))
        point,end = crv.PointAt(ts[1]),crv.PointAt(ts[2])
        if crv.GetLength()>distance*3:
            d_count = crv.GetLength()//distance
            params = crv.DivideByCount(d_count,True)
            pts = [crv.PointAt(t) for t in params[1:len(params)-1]]
        else:
            pts = [point]
        for pt in pts:
            #importnt!! could be used for the text !!
            pln = rg.Plane(pt,rg.Vector3d(end-point))
            #create circles that would intersect the 2 intersecting breps (as if we created a tube from the line of intersection)
            circ = rg.Circle(rg.Plane(pt,rg.Vector3d(end-point)),inter_radius).ToNurbsCurve()
            plane = rg.Brep.CreatePlanarBreps([circ])[0]
            #intersections of the circles patch with each intersecting panel 
            bpx0 = rg.Intersect.Intersection.BrepBrep(inter.breps[0],plane,0.001)
            bpx1 = rg.Intersect.Intersection.BrepBrep(inter.breps[1],plane,0.001)
            cutters = []
            if bpx0 and bpx1:
                cutters.extend([curve for curve in bpx0[1]])
                cutters.extend([curve for curve in bpx1[1]])
                cuts = plane.Split.Overloads[IEnumerable[rg.Curve], System.Double](cutters,0.001)
                circles.append(cuts)
#                 for cut in cuts:
#                     print(type(cut))
#                     count = 0
#                     pcount = 0
#                     flag = 0
#                     #get the edges of each 
#                     for edge in cut.Edges:
#                         count += 1
#                         if edge.Degree == 1:
#                             pcount += 1
#                     if count > 4 and cut.GetArea()> threshold and pcount > 3:
#                         edge_curves = [edge.EdgeCurve for edge in cut.Edges if edge.Degree == 1]
#                         edge_curves.sort(key = lambda e :e.GetLength())
#                         edge_count = 0
#                         for e in edge_curves:
#                             if abs(e.GetLength() - inter_radius) < 0.1:
#                                 big_edge = e
#                             edge_count +=1
#                         small_edge = (edge_curves[3]) if (big_edge.ClosestPoint(edge_curves[1].PointAtStart,7.5)[0] or big_edge.ClosestPoint(edge_curves[1].PointAtEnd,7.5)[0]) and abs(edge_curves[1].GetLength()) > edge_curves[3].GetLength() else (edge_curves[3])
#                         if edge_count<5:
#                             small_edge = edge_curves[2]
#             #           small_edge = edge_curves[3] if edge_curves[2].GetLength()>edge_curves[3].GetLength() else edge_curves[2]
#                         p0,p1 = (small_edge.PointAtStart,small_edge.PointAtEnd) if big_edge.ClosestPoint(small_edge.PointAtStart,7.5)[0] else (small_edge.PointAtEnd,small_edge.PointAtStart)
#                         if big_edge.ClosestPoint(small_edge.PointAtStart,7.5)[0] and big_edge.ClosestPoint(small_edge.PointAtStart,7.5)[0]:
#                             print (big_edge.ClosestPoint(small_edge.PointAtStart,7.5)[1],big_edge.ClosestPoint(small_edge.PointAtEnd,7.5)[1])
#                             closest_pt_start = big_edge.PointAt(big_edge.ClosestPoint(small_edge.PointAtStart,7.5)[1])
#                             start_dist = closest_pt_start.DistanceTo(small_edge.PointAtStart)
#                             closest_pt_end = big_edge.PointAt(big_edge.ClosestPoint(small_edge.PointAtEnd,7.5)[1])
#                             end_dist = closest_pt_end.DistanceTo(small_edge.PointAtEnd)
#                             if start_dist<end_dist:
#                                 p0,p1 = small_edge.PointAtStart,small_edge.PointAtEnd
#                             else:
#                                 p0,p1 = small_edge.PointAtEnd,small_edge.PointAtStart
#                         pp0,pp1 = (big_edge.PointAtStart,big_edge.PointAtEnd) if small_edge.ClosestPoint(big_edge.PointAtStart,7.5)[0] else (big_edge.PointAtEnd,big_edge.PointAtStart)
#                         #rebuild small and big edge for length
#                         vec = rg.Vector3d(p1 - p0)
#                         line = rg.Line(p0,vec,25.0 + FAB_TOL).ToNurbsCurve()
#                         small_edge = line
#                         vec1 = rg.Vector3d(pp1 - pp0)
#                         line1 = rg.Line(pp0,vec1,25.0 + FAB_TOL).ToNurbsCurve()
#                         big_edge = line1
#                         big_edge.Domain = rg.Interval(0,1)
#                         c_pt = big_edge.PointAt(0.5)
#                         clo_pt0 = (inter.breps[0]).ClosestPoint(c_pt,1.0) 
#                         clo_pt1 = (inter.breps[1]).ClosestPoint(c_pt,1.0)
#                         guide_vec = (clo_pt0[5]) if (clo_pt0[0]) else None
#                         print (inter.layer)
#                         #push back big_edge
#                         box_type = 0
#                         if not (inter.layer.Split('-')[0] in B_TAGS or inter.layer.Split('-')[1] in B_TAGS):
#                             if guide_vec is None and clo_pt1[0] :
#                                 guide_vec = clo_pt1[5]
#                             print (guide_vec)
#                             guide_vec.Unitize()
#                             guide_vec *= -3.20
#                             big_edge.Translate(guide_vec)
#                         else:
#                             box_type = 1
#                         if small_edge and big_edge is not None:
#                             fil = rg.Curve.CreateFilletCurves(small_edge,p0,big_edge,pp0,0,True,True,True,True,0.01)
#                             print (fil)
# #                            rg.PolyCurve.SegmentCurve
#                             if fil[0].SegmentCount<2 or min([fil[0].SegmentCurve(i).GetLength() for i in range(fil[0].SegmentCount)])<20:
#                                 print ('fli')
#                                 fil = rg.Curve.CreateFilletCurves(small_edge,p0,big_edge, pp1,0,True,True,True,True,0.01)
#                             fil = fil[0] if len(fil)==1 else None
#                             off = fil.Offset(rg.Point3d((fil.PointAtEnd+fil.PointAtStart)/2),rg.Plane(fil.PointAtEnd,fil.PointAtStart,fil.PointAt(0.5)).ZAxis,3.2,0.01,0.01,False,rg.CurveOffsetCornerStyle.Sharp,rg.CurveOffsetEndStyle.Flat)
#                             if not box_type: b1,b2 = rg.Extrusion.Create(off[0].ToNurbsCurve(),9.0 + FAB_TOL, True),rg.Extrusion.Create(off[0].ToNurbsCurve(),-9.0 - FAB_TOL,True)
#                             else : b1,b2 = rg.Extrusion.Create(off[0].ToNurbsCurve(),15.0 + FAB_TOL, True),rg.Extrusion.Create(off[0].ToNurbsCurve(),-15.0 - FAB_TOL,True)
#                             if b1 and b2 is not None:
#                                 x1 = b1.ToBrep()
#                                 x2 = b2.ToBrep()
#                                 bool = rg.Brep.CreateBooleanUnion([x1,x2],0.001)
#                                 if len(bool)==1:
#                                     bool[0].MergeCoplanarFaces(0.00,0.001)
#                                     bool = bool[0]
#                                 else:
#                                     print 'Boolean not created, check breps'
#                             else:
#                                 print 'Bad Offset Curve, Extrusion not created.'
#                             fillet_indices = []
                            
#                             for edge in bool.Edges:
#                                 if abs(edge.EdgeCurve.GetLength() - 3.2) < 0.5:
#                                     num =  edge.EdgeIndex
#                                     fillet_indices.append(num)
#                             indices = fillet_indices
#                             bbe = rg.Brep.CreateFilletEdges(bool,indices,[2.0 for _ in range(len(indices))],[2.0 for _ in range(len(indices))],rg.BlendType.Fillet,rg.RailType.RollingBall,0.0001)
#                         bbe = bbe[0]
#                         circs.append([small_edge,big_edge,cut])
#                         circs.append(bbe)
#                         tags.append(inter.layer)
    
# sc.doc = doc

# for tag in tags:
#     if tag.Split('-')[0] in B_TAGS or tag.Split('-')[1] in B_TAGS:
#         pass

# if bake:
#     for part,tag in zip(circs,tags):
#         bake_object(part,tag)

# if bake_box:
#     for part,tag in zip(circs,tags):
#         if tag.Split('-')[0] in B_TAGS or tag.Split('-')[1] in B_TAGS:
#             bake_object(part,tag)
    
# sc.doc = ghdoc

# intersections = intersections
# circs = tree(circs)
# ---------- end ghpython_script ----------
box_number = Slider(0, range=0..33)
data_9 = Data(python.cricles)
Z = UnitZ(Factor=Slider(1083, range=100..20000))
python_4 = GhPythonScript(breps=brep, ids=brep, threshold=number_slider_2, distance=number_slider, bake=button, bake_box=button_2)  # -> out, intersections, circs, tags; inputs breps: list of Brep, ids: list of Guid
# ---------- python_4: Python ----------
import Rhino.Geometry as rg
from ghpythonlib.treehelpers import list_to_tree as tree
import scriptcontext as sc
import Rhino.DocObjects as rd
import Rhino.DocObjects.ObjectAttributes as obj_att
from Rhino.RhinoDoc import ActiveDoc as doc
from Grasshopper.Kernel.GH_Convert import ToGUID as guid
import System.Collections.Generic.IEnumerable as IEnumerable
import System
import Rhino
from System import Array
from ghpythonlib.components import FilletEdge
import random as r

def GetObjectLayer(x):
    obj = doc.Objects.Find(x)
    index = obj.Attributes.LayerIndex
    layer = doc.Layers[index]
    return layer.Name

class Intersection(object):
    def __init__(self,crvs,layer,breps,layers):
        self.crvs = crvs
        self.layer = layer
        self.layers = layers
        self.breps = breps

def bake_object(obj,lay,col = 25):
    if obj is not None:
        attr = Rhino.DocObjects.ObjectAttributes()
    if lay is not None: # setting layer
        if rd.Layer.IsValidName(lay):
            layerIndex = sc.doc.Layers.Find(lay, True)
            if layerIndex < 0: # if the layer doesn't exist
                layer = rd.Layer()
                layer.Name = lay
                layer.Color = System.Drawing.Color.FromArgb(255,r.randint(0,255),0,r.randint(0,255))
                layerIndex = sc.doc.Layers.Add(layer)
            attr.LayerIndex = layerIndex
    
#    displayColor = Rhino.Display.ColorRGBA(layerIndex)
    sc.doc.Objects.AddBrep(obj, attr)

FAB_TOL = 0.15

B_TAGS = ('TO','BO','LF','RI','BA','IT','IB','IL','IR')

inter_radius = 10.0

intersections = []
for brep0,id0 in zip(breps,ids):
    layer0 = GetObjectLayer(id0)
    for brep1,id1 in zip(breps,ids):
        layer1 = GetObjectLayer(id1)
        if (brep0 is not brep1) and (("%s-%s"%(layer0,layer1) not in [int.layer for int in intersections])) and (("%s-%s"%(layer1,layer0) not in [int.layer for int in intersections])) and (layer1 not in B_TAGS or layer0 not in B_TAGS):
#            print ("%s-%s"%(layer0,layer1)),"%s-%s"%(layer1,layer0), [int.layer for int in intersections]
            bbx = rg.Intersect.Intersection.BrepBrep(brep0,brep1,0.001)
            if bbx and len(bbx[1])>0:
                list_intersections = []
                for bx in bbx[1]:
                    if bx.GetLength() > 25:
                        list_intersections.append(bx)
                    else:
                        print 'small'
                interX = Intersection(list_intersections,"%s-%s"%(layer0,layer1),[brep0,brep1],[layer0,layer1])
                intersections.append(interX)

circs,tags = [],[]
for inter in intersections:
    for crv in inter.crvs:
        ts =  crv.DivideByCount(2,True)
        point,end = crv.PointAt(ts[1]),crv.PointAt(ts[2])
        if crv.GetLength()>distance*3:
            d_count = crv.GetLength()//distance
            params = crv.DivideByCount(d_count,True)
            pts = [crv.PointAt(t) for t in params[1:len(params)-1]]
        else:
            pts = [point]
        for pt in pts:
            pln = rg.Plane(pt,rg.Vector3d(end-point))
            circ = rg.Circle(rg.Plane(pt,rg.Vector3d(end-point)),inter_radius).ToNurbsCurve()
            plane = rg.Brep.CreatePlanarBreps([circ])[0]
            bpx0 = rg.Intersect.Intersection.BrepBrep(inter.breps[0],plane,0.001)
            bpx1 = rg.Intersect.Intersection.BrepBrep(inter.breps[1],plane,0.001)
            cutters = []
            if bpx0 and bpx1:
                cutters.extend([curve for curve in bpx0[1]])
                cutters.extend([curve for curve in bpx1[1]])
                cuts = plane.Split.Overloads[IEnumerable[rg.Curve], System.Double](cutters,0.001)
                for cut in cuts:
                    count = 0
                    pcount = 0
                    flag = 0
                    for edge in cut.Edges:
                        count += 1
                        if edge.Degree == 1:
                            pcount += 1
                    if count>4 and cut.GetArea()>threshold and pcount>3:
                        edge_curves = [edge.EdgeCurve for edge in cut.Edges if edge.Degree == 1]
                        edge_curves.sort(key = lambda e :e.GetLength())
                        edge_count = 0
                        for e in edge_curves:
                            if abs(e.GetLength() - inter_radius) < 0.1:
                                big_edge = e
                            edge_count +=1
                        small_edge = (edge_curves[3]) if (big_edge.ClosestPoint(edge_curves[1].PointAtStart,7.5)[0] or big_edge.ClosestPoint(edge_curves[1].PointAtEnd,7.5)[0]) and abs(edge_curves[1].GetLength()) > edge_curves[3].GetLength() else (edge_curves[3])
                        if edge_count<5:
                            small_edge = edge_curves[2]
            #           small_edge = edge_curves[3] if edge_curves[2].GetLength()>edge_curves[3].GetLength() else edge_curves[2]
                        p0,p1 = (small_edge.PointAtStart,small_edge.PointAtEnd) if big_edge.ClosestPoint(small_edge.PointAtStart,7.5)[0] else (small_edge.PointAtEnd,small_edge.PointAtStart)
                        if big_edge.ClosestPoint(small_edge.PointAtStart,7.5)[0] and big_edge.ClosestPoint(small_edge.PointAtStart,7.5)[0]:
                            print big_edge.ClosestPoint(small_edge.PointAtStart,7.5)[1],big_edge.ClosestPoint(small_edge.PointAtEnd,7.5)[1]
                            closest_pt_start = big_edge.PointAt(big_edge.ClosestPoint(small_edge.PointAtStart,7.5)[1])
                            start_dist = closest_pt_start.DistanceTo(small_edge.PointAtStart)
                            closest_pt_end = big_edge.PointAt(big_edge.ClosestPoint(small_edge.PointAtEnd,7.5)[1])
                            end_dist = closest_pt_end.DistanceTo(small_edge.PointAtEnd)
                            if start_dist<end_dist:
                                p0,p1 = small_edge.PointAtStart,small_edge.PointAtEnd
                            else:
                                p0,p1 = small_edge.PointAtEnd,small_edge.PointAtStart
                        pp0,pp1 = (big_edge.PointAtStart,big_edge.PointAtEnd) if small_edge.ClosestPoint(big_edge.PointAtStart,7.5)[0] else (big_edge.PointAtEnd,big_edge.PointAtStart)
                        #rebuild small and big edge for length
                        vec = rg.Vector3d(p1 - p0)
                        line = rg.Line(p0,vec,25.0 + FAB_TOL).ToNurbsCurve()
                        small_edge = line
                        vec1 = rg.Vector3d(pp1 - pp0)
                        line1 = rg.Line(pp0,vec1,25.0 + FAB_TOL).ToNurbsCurve()
                        big_edge = line1
                        big_edge.Domain = rg.Interval(0,1)
                        c_pt = big_edge.PointAt(0.5)
                        clo_pt0 = (inter.breps[0]).ClosestPoint(c_pt,1.0) 
                        clo_pt1 = (inter.breps[1]).ClosestPoint(c_pt,1.0)
                        guide_vec = (clo_pt0[5]) if (clo_pt0[0]) else None
                        print inter.layer
                        #push back big_edge
                        box_type = 0
                        if not (inter.layer.Split('-')[0] in B_TAGS or inter.layer.Split('-')[1] in B_TAGS):
                            if guide_vec is None and clo_pt1[0] :
                                guide_vec = clo_pt1[5]
                            guide_vec.Unitize()
                            guide_vec *= -3.20
                            big_edge.Translate(guide_vec)
                        else:
                            box_type = 1
                        if small_edge and big_edge is not None:
                            fil = rg.Curve.CreateFilletCurves(small_edge,p0,big_edge,pp0,0,True,True,True,True,0.01)
                            print fil
#                            rg.PolyCurve.SegmentCurve
                            if fil[0].SegmentCount<2 or min([fil[0].SegmentCurve(i).GetLength() for i in range(fil[0].SegmentCount)])<20:
                                print 'fli'
                                fil = rg.Curve.CreateFilletCurves(small_edge,p0,big_edge, pp1,0,True,True,True,True,0.01)
                            fil = fil[0] if len(fil)==1 else None
                            off = fil.Offset(rg.Point3d((fil.PointAtEnd+fil.PointAtStart)/2),rg.Plane(fil.PointAtEnd,fil.PointAtStart,fil.PointAt(0.5)).ZAxis,3.2,0.01,0.01,False,rg.CurveOffsetCornerStyle.Sharp,rg.CurveOffsetEndStyle.Flat)
                            if not box_type: b1,b2 = rg.Extrusion.Create(off[0].ToNurbsCurve(),9.0 + FAB_TOL, True),rg.Extrusion.Create(off[0].ToNurbsCurve(),-9.0 - FAB_TOL,True)
                            else : b1,b2 = rg.Extrusion.Create(off[0].ToNurbsCurve(),15.0 + FAB_TOL, True),rg.Extrusion.Create(off[0].ToNurbsCurve(),-15.0 - FAB_TOL,True)
                            if b1 and b2 is not None:
                                x1 = b1.ToBrep()
                                x2 = b2.ToBrep()
                                bool = rg.Brep.CreateBooleanUnion([x1,x2],0.001)
                                if len(bool)==1:
                                    bool[0].MergeCoplanarFaces(0.00,0.001)
                                    bool = bool[0]
                                else:
                                    print 'Boolean not created, check breps'
                            else:
                                print 'Bad Offset Curve, Extrusion not created.'
                            fillet_indices = []
                            
                            for edge in bool.Edges:
                                if abs(edge.EdgeCurve.GetLength() - 3.2) < 0.5:
                                    num =  edge.EdgeIndex
                                    fillet_indices.append(num)
                            indices = fillet_indices
                            bbe = rg.Brep.CreateFilletEdges(bool,indices,[2.0 for _ in range(len(indices))],[2.0 for _ in range(len(indices))],rg.BlendType.Fillet,rg.RailType.RollingBall,0.0001)
                        bbe = bbe[0]
                        circs.append([small_edge,big_edge,cut])
                        circs.append(bbe)
                        tags.append(inter.layer)
    
sc.doc = doc

for tag in tags:
    if tag.Split('-')[0] in B_TAGS or tag.Split('-')[1] in B_TAGS:
        pass

if bake:
    for part,tag in zip(circs,tags):
        bake_object(part,tag)

if bake_box:
    for part,tag in zip(circs,tags):
        if tag.Split('-')[0] in B_TAGS or tag.Split('-')[1] in B_TAGS:
            bake_object(part,tag)
    
sc.doc = ghdoc

intersections = intersections
circs = tree(circs)
# ---------- end python_4 ----------
ln = Line(StartPoint=python.p0s, EndPoint=python.p1s)
read_file = ReadFile(File=panel, PerLineParse=False)
data_10 = Data(python_2.a)
ln_2 = Line(StartPoint=python.p01s, EndPoint=python.p02s)
move = Move(Geometry=python_3.a, Motion=Z)  # -> Geometry, Transform
item_2 = ListItem(List=brep, Index=0, Wrap=True)  # -> Item, Item1, Item2, Item3, Item4, Item5, Item6, Item7
ghpython_script_2 = GhPythonScript(
    Code=read_file,
    Breps=brep_2,
    Ids=brep_2,
    Threshold=number_slider_2,
    Distance=number_slider,
    Bake=button,
    Bake_box=button_2,
    Inter_tol_breps=p_n_c,
    Dup_lines_tol=number_slider_3,
    Lines_list=crv,
    Box_number=box_number,
    Move_text_distance=Slider(29, range=10..200))  # -> Out, Intersections, Circs, Tags, Circles, Lines, Sm_edges, Big_edges, P0s, Edges_3
panel_2 = Panel(p_n_c)
data_11 = Data(item_2.Item6)
data_12 = Data(item_2.Item)
data_13 = Data(ghpython_script_2.Big_edges)
data_14 = Data(ghpython_script_2.Sm_edges)
knob_2 = ControlKnob(Decimals=0, Limit=True, Maximum=500, Minimum=0, Range=10, Value=0)
data_15 = Data(ghpython_script_2.P0s)
data_16 = Data(ghpython_script_2.Edges_3)
X = UnitX(Factor=reverse(Slider(7302, range=100..10000)))
number_slider_4 = Slider(68, range=0..500)
python_5 = GhPythonScript(inter=ghpython_script_2.Intersections)  # -> out, a, b; inputs inter: list; same code as python_2
python_6 = GhPythonScript(x=ghpython_script_2.Circles)  # -> out, simplify(a); same code as python_3
data_17 = Data(python_6.a)
item_3 = ListItem(List=data_17, Index=knob_2, Wrap=True)
knob_3 = ControlKnob(Decimals=0, Limit=True, Maximum=500, Minimum=0, Range=10, Value=4)
data_18 = Data(item_3)
move_2 = Move(Geometry=python_5.a, Motion=reverse(X))  # -> Geometry, Transform
path = ConstructPath(Indices=knob_3)
move_3 = Move(Geometry=python_6.a, Motion=X)  # -> Geometry, Transform
panel_3 = Panel(ghpython_script_2.Tags)
branch = TreeBranch(Tree=data_17, Path=path, MaintainPaths=True)
item_4 = ListItem(List=branch, Index=Slider(3, range=0..4), Wrap=True)
panel_4 = Panel(ghpython_script_2.Out)
