# Grasshopper definition 230226_fixing_numbering_ brackets.gh (Grasshopper 1.0.7)

brep = Brep([<brep referenced from the Rhino model> x9])
brep_2 = Brep([<brep referenced from the Rhino model> x9])
# Input baked geometry to generate holding brackets
merge = Merge(Data1=brep_2, Data2=brep)

number_slider = Slider(50, range=0..200)
number_slider_2 = Slider(90, range=0..300)
button = Button()
# Adjust threshold and distance b/w brackets as needed
button_2 = Button()
brep_3 = Brep(flatten(merge))
python = GhPythonScript(breps=brep_3, ids=brep_3, threshold=number_slider, distance=number_slider_2, bake=button, bake_box=button_2)  # -> out, intersections, circs, tags; inputs breps: list of Brep, ids: list of Guid
# ---------- python: Python ----------
import Rhino.Geometry as rg
from ghpythonlib.treehelpers import list_to_tree as tree
import scriptcontext as sc
import Rhino.DocObjects as rd
import Rhino.DocObjects.ObjectAttributes as obj_att
from Rhino.RhinoDoc import ActiveDoc as doc
from Grasshopper.Kernel.GH_Convert import ToGUID as guid
import System.Collections.Generic.IEnumerable as IEnumerable
import System
import Rhino
from System import Array
from ghpythonlib.components import FilletEdge
import random as r

def GetObjectLayer(x):
    obj = doc.Objects.Find(x)
    index = obj.Attributes.LayerIndex
    layer = doc.Layers[index]
    return layer.Name

class Intersection(object):
    def __init__(self,crvs,layer,breps,layers):
        self.crvs = crvs
        self.layer = layer
        self.layers = layers
        self.breps = breps

def bake_object(obj,lay,col = 25):
    if obj is not None:
        attr = Rhino.DocObjects.ObjectAttributes()
    if lay is not None: # setting layer
        if rd.Layer.IsValidName(lay):
            layerIndex = sc.doc.Layers.Find(lay, True)
            if layerIndex < 0: # if the layer doesn't exist
                layer = rd.Layer()
                layer.Name = lay
                layer.Color = System.Drawing.Color.FromArgb(255,r.randint(0,255),0,r.randint(0,255))
                layerIndex = sc.doc.Layers.Add(layer)
            attr.LayerIndex = layerIndex

#    displayColor = Rhino.Display.ColorRGBA(layerIndex)
    sc.doc.Objects.AddBrep(obj, attr)

from Rhino.Geometry import *

text_entity = TextEntity()
text_entity.Plane = Plane.WorldXY
text_entity.Text = "Hello Rhino!"
text_entity.Justification = TextJustification.MiddleCenter
text_entity.FontIndex = doc.Fonts.FindOrCreate("Arial", False, False)
print(text_entity.Text)
doc.Objects.AddText(text_entity)
doc.Views.Redraw()

FAB_TOL = 0.15

B_TAGS = ('TO','BO','LF','RI','BA','IT','IB','IL','IR')

inter_radius = 10.0

intersections = []
for brep0,id0 in zip(breps,ids):
    layer0 = GetObjectLayer(id0)
    for brep1,id1 in zip(breps,ids):
        layer1 = GetObjectLayer(id1)
        if (brep0 is not brep1) and (("%s-%s"%(layer0,layer1) not in [int.layer for int in intersections])) and (("%s-%s"%(layer1,layer0) not in [int.layer for int in intersections])) and (layer1 not in B_TAGS or layer0 not in B_TAGS):
#            print ("%s-%s"%(layer0,layer1)),"%s-%s"%(layer1,layer0), [int.layer for int in intersections]
            bbx = rg.Intersect.Intersection.BrepBrep(brep0,brep1,1)
            if bbx and len(bbx[1])>0:
                list_intersections = []
                for bx in bbx[1]:
                    if bx.GetLength() > 25:
                        list_intersections.append(bx)
                    else:
                        print 'small'
                interX = Intersection(list_intersections,"%s-%s"%(layer0,layer1),[brep0,brep1],[layer0,layer1])
                intersections.append(interX)

circs,tags = [],[]
for inter in intersections:
    for crv in inter.crvs:
        ts =  crv.DivideByCount(2,True)
        point,end = crv.PointAt(ts[1]),crv.PointAt(ts[2])
        if crv.GetLength()>distance*3:
            d_count = crv.GetLength()//distance
            params = crv.DivideByCount(d_count,True)
            pts = [crv.PointAt(t) for t in params[1:len(params)-1]]
        else:
            pts = [point]
        for pt in pts:
            pln = rg.Plane(pt,rg.Vector3d(end-point))
            circ = rg.Circle(rg.Plane(pt,rg.Vector3d(end-point)),inter_radius).ToNurbsCurve()
            plane = rg.Brep.CreatePlanarBreps([circ])[0]
            bpx0 = rg.Intersect.Intersection.BrepBrep(inter.breps[0],plane,0.001)
            bpx1 = rg.Intersect.Intersection.BrepBrep(inter.breps[1],plane,0.001)
            cutters = []
            if bpx0 and bpx1:
                cutters.extend([curve for curve in bpx0[1]])
                cutters.extend([curve for curve in bpx1[1]])
                cuts = plane.Split.Overloads[IEnumerable[rg.Curve], System.Double](cutters,0.001)
                for cut in cuts:
                    count = 0
                    pcount = 0
                    flag = 0
                    for edge in cut.Edges:
                        count += 1
                        if edge.Degree == 1:
                            pcount += 1
                    if count>4 and cut.GetArea()>threshold and pcount>3:
                        edge_curves = [edge.EdgeCurve for edge in cut.Edges if edge.Degree == 1]
                        edge_curves.sort(key = lambda e :e.GetLength())
                        edge_count = 0
                        for e in edge_curves:
                            if abs(e.GetLength() - inter_radius) < 0.1:
                                big_edge = e
                            edge_count +=1
                        small_edge = (edge_curves[3]) if (big_edge.ClosestPoint(edge_curves[1].PointAtStart,7.5)[0] or big_edge.ClosestPoint(edge_curves[1].PointAtEnd,7.5)[0]) and abs(edge_curves[1].GetLength()) > edge_curves[3].GetLength() else (edge_curves[3])
                        if edge_count<5:
                            small_edge = edge_curves[2]
            #           small_edge = edge_curves[3] if edge_curves[2].GetLength()>edge_curves[3].GetLength() else edge_curves[2]
                        p0,p1 = (small_edge.PointAtStart,small_edge.PointAtEnd) if big_edge.ClosestPoint(small_edge.PointAtStart,7.5)[0] else (small_edge.PointAtEnd,small_edge.PointAtStart)
                        if big_edge.ClosestPoint(small_edge.PointAtStart,7.5)[0] and big_edge.ClosestPoint(small_edge.PointAtStart,7.5)[0]:
                            print big_edge.ClosestPoint(small_edge.PointAtStart,7.5)[1],big_edge.ClosestPoint(small_edge.PointAtEnd,7.5)[1]
                            closest_pt_start = big_edge.PointAt(big_edge.ClosestPoint(small_edge.PointAtStart,7.5)[1])
                            start_dist = closest_pt_start.DistanceTo(small_edge.PointAtStart)
                            closest_pt_end = big_edge.PointAt(big_edge.ClosestPoint(small_edge.PointAtEnd,7.5)[1])
                            end_dist = closest_pt_end.DistanceTo(small_edge.PointAtEnd)
                            if start_dist<end_dist:
                                p0,p1 = small_edge.PointAtStart,small_edge.PointAtEnd
                            else:
                                p0,p1 = small_edge.PointAtEnd,small_edge.PointAtStart
                        pp0,pp1 = (big_edge.PointAtStart,big_edge.PointAtEnd) if small_edge.ClosestPoint(big_edge.PointAtStart,7.5)[0] else (big_edge.PointAtEnd,big_edge.PointAtStart)
                        #rebuild small and big edge for length
                        vec = rg.Vector3d(p1 - p0)
                        line = rg.Line(p0,vec,25.0 + FAB_TOL).ToNurbsCurve()
                        small_edge = line
                        vec1 = rg.Vector3d(pp1 - pp0)
                        line1 = rg.Line(pp0,vec1,25.0 + FAB_TOL).ToNurbsCurve()
                        big_edge = line1
                        big_edge.Domain = rg.Interval(0,1)
                        c_pt = big_edge.PointAt(0.5)
                        clo_pt0 = (inter.breps[0]).ClosestPoint(c_pt,1.0) 
                        clo_pt1 = (inter.breps[1]).ClosestPoint(c_pt,1.0)
                        guide_vec = (clo_pt0[5]) if (clo_pt0[0]) else None
                        print inter.layer
                        #push back big_edge
                        box_type = 0
                        if not (inter.layer.Split('-')[0] in B_TAGS or inter.layer.Split('-')[1] in B_TAGS):
                            if guide_vec is None and clo_pt1[0] :
                                guide_vec = clo_pt1[5]
                            guide_vec.Unitize()
                            guide_vec *= -3.20
                            big_edge.Translate(guide_vec)
                        else:
                            box_type = 1
                        if small_edge and big_edge is not None:
                            fil = rg.Curve.CreateFilletCurves(small_edge,p0,big_edge,pp0,0,True,True,True,True,0.01)
                            print fil
#                            rg.PolyCurve.SegmentCurve
                            if fil[0].SegmentCount<2 or min([fil[0].SegmentCurve(i).GetLength() for i in range(fil[0].SegmentCount)])<20:
                                print 'fli'
                                fil = rg.Curve.CreateFilletCurves(small_edge,p0,big_edge, pp1,0,True,True,True,True,0.01)
                            fil = fil[0] if len(fil)==1 else None
                            off = fil.Offset(rg.Point3d((fil.PointAtEnd+fil.PointAtStart)/2),rg.Plane(fil.PointAtEnd,fil.PointAtStart,fil.PointAt(0.5)).ZAxis,3.2,0.01,0.01,False,rg.CurveOffsetCornerStyle.Sharp,rg.CurveOffsetEndStyle.Flat)
                            if not box_type: b1,b2 = rg.Extrusion.Create(off[0].ToNurbsCurve(),9.0 + FAB_TOL, True),rg.Extrusion.Create(off[0].ToNurbsCurve(),-9.0 - FAB_TOL,True)
                            else : b1,b2 = rg.Extrusion.Create(off[0].ToNurbsCurve(),15.0 + FAB_TOL, True),rg.Extrusion.Create(off[0].ToNurbsCurve(),-15.0 - FAB_TOL,True)
                            if b1 and b2 is not None:
                                x1 = b1.ToBrep()
                                x2 = b2.ToBrep()
                                bool = rg.Brep.CreateBooleanUnion([x1,x2],0.001)
                                if len(bool)==1:
                                    bool[0].MergeCoplanarFaces(0.00,0.001)
                                    bool = bool[0]
                                else:
                                    print 'Boolean not created, check breps'
                            else:
                                print 'Bad Offset Curve, Extrusion not created.'
                            fillet_indices = []
                            
                            for edge in bool.Edges:
                                if abs(edge.EdgeCurve.GetLength() - 3.2) < 0.5:
                                    num =  edge.EdgeIndex
                                    fillet_indices.append(num)
                            indices = fillet_indices
                            bbe = rg.Brep.CreateFilletEdges(bool,indices,[2.0 for _ in range(len(indices))],[2.0 for _ in range(len(indices))],rg.BlendType.Fillet,rg.RailType.RollingBall,0.0001)
                        bbe = bbe[0]
                        circs.append([small_edge,big_edge,cut])
                        circs.append(bbe)
                        tags.append(inter.layer)
    
sc.doc = doc

for tag in tags:
    if tag.Split('-')[0] in B_TAGS or tag.Split('-')[1] in B_TAGS:
        pass

if bake:
    for part,tag in zip(circs,tags):
        bake_object(part,tag)

if bake_box:
    for part,tag in zip(circs,tags):
        if tag.Split('-')[0] in B_TAGS or tag.Split('-')[1] in B_TAGS:
            bake_object(part,tag)
    
sc.doc = ghdoc

intersections = intersections
circs = tree(circs)
# ---------- end python ----------
python_2 = GhPythonScript(inter=python.intersections)  # -> out, a, b; inputs inter: list
# ---------- python_2: Python ----------
import Rhino.Geometry as rg

a,b= [],[]
for int in inter:
    a.extend(int.crvs)
    b.append(int.layer)
# ---------- end python_2 ----------

# ----
# Press bake to bake!
panel = Panel("C:\Users\ahmed\OneDrive - Politecnico di Milano\ETH Zurich\HIWI\Neuramod Project\Neuramod-Support\Neuramod-Support\brackets_numbering\20230221_Brackets_panels_numbering.py")
button_3 = Button()
data = Data(python_2.a)
python_3 = GhPythonScript(breps=brep_3, ids=brep_3, threshold=number_slider, distance=number_slider_2, bake=button, bake_box=button_2)  # -> out, intersections, circs, tags; inputs breps: list of Brep, ids: list of Guid
# ---------- python_3: Python ----------
import Rhino.Geometry as rg
from ghpythonlib.treehelpers import list_to_tree as tree
import scriptcontext as sc
import Rhino.DocObjects as rd
import Rhino.DocObjects.ObjectAttributes as obj_att
from Rhino.RhinoDoc import ActiveDoc as doc
from Grasshopper.Kernel.GH_Convert import ToGUID as guid
import System.Collections.Generic.IEnumerable as IEnumerable
import System
import Rhino
from System import Array
from ghpythonlib.components import FilletEdge
import random as r

def GetObjectLayer(x):
    obj = doc.Objects.Find(x)
    index = obj.Attributes.LayerIndex
    layer = doc.Layers[index]
    return layer.Name

class Intersection(object):
    def __init__(self,crvs,layer,breps,layers):
        self.crvs = crvs
        self.layer = layer
        self.layers = layers
        self.breps = breps

def bake_object(obj,lay,col = 25):
    if obj is not None:
        attr = Rhino.DocObjects.ObjectAttributes()
    if lay is not None: # setting layer
        if rd.Layer.IsValidName(lay):
            layerIndex = sc.doc.Layers.Find(lay, True)
            if layerIndex < 0: # if the layer doesn't exist
                layer = rd.Layer()
                layer.Name = lay
                layer.Color = System.Drawing.Color.FromArgb(255,r.randint(0,255),0,r.randint(0,255))
                layerIndex = sc.doc.Layers.Add(layer)
            attr.LayerIndex = layerIndex
    
#    displayColor = Rhino.Display.ColorRGBA(layerIndex)
    sc.doc.Objects.AddBrep(obj, attr)

FAB_TOL = 0.15

B_TAGS = ('TO','BO','LF','RI','BA','IT','IB','IL','IR')

inter_radius = 10.0

intersections = []
for brep0,id0 in zip(breps,ids):
    layer0 = GetObjectLayer(id0)
    for brep1,id1 in zip(breps,ids):
        layer1 = GetObjectLayer(id1)
        if (brep0 is not brep1) and (("%s-%s"%(layer0,layer1) not in [int.layer for int in intersections])) and (("%s-%s"%(layer1,layer0) not in [int.layer for int in intersections])) and (layer1 not in B_TAGS or layer0 not in B_TAGS):
#            print ("%s-%s"%(layer0,layer1)),"%s-%s"%(layer1,layer0), [int.layer for int in intersections]
            bbx = rg.Intersect.Intersection.BrepBrep(brep0,brep1,0.001)
            if bbx and len(bbx[1])>0:
                list_intersections = []
                for bx in bbx[1]:
                    if bx.GetLength() > 25:
                        list_intersections.append(bx)
                    else:
                        print 'small'
                interX = Intersection(list_intersections,"%s-%s"%(layer0,layer1),[brep0,brep1],[layer0,layer1])
                intersections.append(interX)

circs,tags = [],[]
for inter in intersections:
    for crv in inter.crvs:
        ts =  crv.DivideByCount(2,True)
        point,end = crv.PointAt(ts[1]),crv.PointAt(ts[2])
        if crv.GetLength()>distance*3:
            d_count = crv.GetLength()//distance
            params = crv.DivideByCount(d_count,True)
            pts = [crv.PointAt(t) for t in params[1:len(params)-1]]
        else:
            pts = [point]
        for pt in pts:
            pln = rg.Plane(pt,rg.Vector3d(end-point))
            circ = rg.Circle(rg.Plane(pt,rg.Vector3d(end-point)),inter_radius).ToNurbsCurve()
            plane = rg.Brep.CreatePlanarBreps([circ])[0]
            bpx0 = rg.Intersect.Intersection.BrepBrep(inter.breps[0],plane,0.001)
            bpx1 = rg.Intersect.Intersection.BrepBrep(inter.breps[1],plane,0.001)
            cutters = []
            if bpx0 and bpx1:
                cutters.extend([curve for curve in bpx0[1]])
                cutters.extend([curve for curve in bpx1[1]])
                cuts = plane.Split.Overloads[IEnumerable[rg.Curve], System.Double](cutters,0.001)
                for cut in cuts:
                    count = 0
                    pcount = 0
                    flag = 0
                    for edge in cut.Edges:
                        count += 1
                        if edge.Degree == 1:
                            pcount += 1
                    if count>4 and cut.GetArea()>threshold and pcount>3:
                        edge_curves = [edge.EdgeCurve for edge in cut.Edges if edge.Degree == 1]
                        edge_curves.sort(key = lambda e :e.GetLength())
                        edge_count = 0
                        for e in edge_curves:
                            if abs(e.GetLength() - inter_radius) < 0.1:
                                big_edge = e
                            edge_count +=1
                        small_edge = (edge_curves[3]) if (big_edge.ClosestPoint(edge_curves[1].PointAtStart,7.5)[0] or big_edge.ClosestPoint(edge_curves[1].PointAtEnd,7.5)[0]) and abs(edge_curves[1].GetLength()) > edge_curves[3].GetLength() else (edge_curves[3])
                        if edge_count<5:
                            small_edge = edge_curves[2]
            #           small_edge = edge_curves[3] if edge_curves[2].GetLength()>edge_curves[3].GetLength() else edge_curves[2]
                        p0,p1 = (small_edge.PointAtStart,small_edge.PointAtEnd) if big_edge.ClosestPoint(small_edge.PointAtStart,7.5)[0] else (small_edge.PointAtEnd,small_edge.PointAtStart)
                        if big_edge.ClosestPoint(small_edge.PointAtStart,7.5)[0] and big_edge.ClosestPoint(small_edge.PointAtStart,7.5)[0]:
                            print big_edge.ClosestPoint(small_edge.PointAtStart,7.5)[1],big_edge.ClosestPoint(small_edge.PointAtEnd,7.5)[1]
                            closest_pt_start = big_edge.PointAt(big_edge.ClosestPoint(small_edge.PointAtStart,7.5)[1])
                            start_dist = closest_pt_start.DistanceTo(small_edge.PointAtStart)
                            closest_pt_end = big_edge.PointAt(big_edge.ClosestPoint(small_edge.PointAtEnd,7.5)[1])
                            end_dist = closest_pt_end.DistanceTo(small_edge.PointAtEnd)
                            if start_dist<end_dist:
                                p0,p1 = small_edge.PointAtStart,small_edge.PointAtEnd
                            else:
                                p0,p1 = small_edge.PointAtEnd,small_edge.PointAtStart
                        pp0,pp1 = (big_edge.PointAtStart,big_edge.PointAtEnd) if small_edge.ClosestPoint(big_edge.PointAtStart,7.5)[0] else (big_edge.PointAtEnd,big_edge.PointAtStart)
                        #rebuild small and big edge for length
                        vec = rg.Vector3d(p1 - p0)
                        line = rg.Line(p0,vec,25.0 + FAB_TOL).ToNurbsCurve()
                        small_edge = line
                        vec1 = rg.Vector3d(pp1 - pp0)
                        line1 = rg.Line(pp0,vec1,25.0 + FAB_TOL).ToNurbsCurve()
                        big_edge = line1
                        big_edge.Domain = rg.Interval(0,1)
                        c_pt = big_edge.PointAt(0.5)
                        clo_pt0 = (inter.breps[0]).ClosestPoint(c_pt,1.0) 
                        clo_pt1 = (inter.breps[1]).ClosestPoint(c_pt,1.0)
                        guide_vec = (clo_pt0[5]) if (clo_pt0[0]) else None
                        print inter.layer
                        #push back big_edge
                        box_type = 0
                        if not (inter.layer.Split('-')[0] in B_TAGS or inter.layer.Split('-')[1] in B_TAGS):
                            if guide_vec is None and clo_pt1[0] :
                                guide_vec = clo_pt1[5]
                            guide_vec.Unitize()
                            guide_vec *= -3.20
                            big_edge.Translate(guide_vec)
                        else:
                            box_type = 1
                        if small_edge and big_edge is not None:
                            fil = rg.Curve.CreateFilletCurves(small_edge,p0,big_edge,pp0,0,True,True,True,True,0.01)
                            print fil
#                            rg.PolyCurve.SegmentCurve
                            if fil[0].SegmentCount<2 or min([fil[0].SegmentCurve(i).GetLength() for i in range(fil[0].SegmentCount)])<20:
                                print 'fli'
                                fil = rg.Curve.CreateFilletCurves(small_edge,p0,big_edge, pp1,0,True,True,True,True,0.01)
                            fil = fil[0] if len(fil)==1 else None
                            off = fil.Offset(rg.Point3d((fil.PointAtEnd+fil.PointAtStart)/2),rg.Plane(fil.PointAtEnd,fil.PointAtStart,fil.PointAt(0.5)).ZAxis,3.2,0.01,0.01,False,rg.CurveOffsetCornerStyle.Sharp,rg.CurveOffsetEndStyle.Flat)
                            if not box_type: b1,b2 = rg.Extrusion.Create(off[0].ToNurbsCurve(),9.0 + FAB_TOL, True),rg.Extrusion.Create(off[0].ToNurbsCurve(),-9.0 - FAB_TOL,True)
                            else : b1,b2 = rg.Extrusion.Create(off[0].ToNurbsCurve(),15.0 + FAB_TOL, True),rg.Extrusion.Create(off[0].ToNurbsCurve(),-15.0 - FAB_TOL,True)
                            if b1 and b2 is not None:
                                x1 = b1.ToBrep()
                                x2 = b2.ToBrep()
                                bool = rg.Brep.CreateBooleanUnion([x1,x2],0.001)
                                if len(bool)==1:
                                    bool[0].MergeCoplanarFaces(0.00,0.001)
                                    bool = bool[0]
                                else:
                                    print 'Boolean not created, check breps'
                            else:
                                print 'Bad Offset Curve, Extrusion not created.'
                            fillet_indices = []
                            
                            for edge in bool.Edges:
                                if abs(edge.EdgeCurve.GetLength() - 3.2) < 0.5:
                                    num =  edge.EdgeIndex
                                    fillet_indices.append(num)
                            indices = fillet_indices
                            bbe = rg.Brep.CreateFilletEdges(bool,indices,[2.0 for _ in range(len(indices))],[2.0 for _ in range(len(indices))],rg.BlendType.Fillet,rg.RailType.RollingBall,0.0001)
                        bbe = bbe[0]
                        circs.append([small_edge,big_edge,cut])
                        circs.append(bbe)
                        tags.append(inter.layer)
    
sc.doc = doc

for tag in tags:
    if tag.Split('-')[0] in B_TAGS or tag.Split('-')[1] in B_TAGS:
        pass

if bake:
    for part,tag in zip(circs,tags):
        bake_object(part,tag)

if bake_box:
    for part,tag in zip(circs,tags):
        if tag.Split('-')[0] in B_TAGS or tag.Split('-')[1] in B_TAGS:
            bake_object(part,tag)
    
sc.doc = ghdoc

intersections = intersections
circs = tree(circs)
# ---------- end python_3 ----------
read_file = ReadFile(File=panel, PerLineParse=False)
item = ListItem(List=brep_3, Index=0, Wrap=True)  # -> Item, Item1, Item2, Item3, Item4, Item5, Item6, Item7
ghpython_script = GhPythonScript(
    Code=read_file,
    Breps=brep_3,
    Ids=brep_3,
    Threshold=number_slider,
    Distance=number_slider_2,
    Bake=button,
    Bake_box=button_2)  # -> Out, Intersections, Circs, Tags, Circles
python_4 = GhPythonScript()  # -> out, a
# ---------- python_4: Python ----------
from scriptcontext import doc
from Rhino.Geometry import *

text_entity = TextEntity()
text_entity.Plane = Plane.WorldXY
text_entity.Text = "Hello Rhino!"
text_entity.Justification = TextJustification.MiddleCenter
text_entity.FontIndex = doc.Fonts.FindOrCreate("Arial", False, False)

doc.Objects.AddText(text_entity)
doc.Views.Redraw()
# ---------- end python_4 ----------
data_2 = Data(item.Item6)
panel_2 = Panel(python.out)
data_3 = Data(item.Item)
data_4 = Data(python_3.out)
knob = ControlKnob(Decimals=0, Limit=True, Maximum=50, Minimum=0, Range=10, Value=0)
python_5 = GhPythonScript(inter=ghpython_script.Intersections)  # -> out, a, b; inputs inter: list; same code as python_2
python_6 = GhPythonScript(x=ghpython_script.Circles)  # -> out, a
# ---------- python_6: Python ----------
a = x
# ---------- end python_6 ----------
bang = ExplodeTree(Data=python_6.a)  # -> Branch0, Branch1
item_2 = ListItem(List=knob, Index=python_5.a, Wrap=True)
data_5 = Data(bang.Branch1)
panel_3 = Panel(python_5.out)
