# Grasshopper definition 230305_fixing_numbering_ brackets.gh (Grasshopper 1.0.7)
# plug-ins: NGon

# ---- group: Insert Box Number
brep = Brep(<brep referenced from the Rhino model>)

# ----
box_14__breps_after_operations = Brep([<brep referenced from the Rhino model> x10])
breps_box_4_after_operations = Brep([<brep referenced from the Rhino model> x6])
brep_2 = Brep([<brep referenced from the Rhino model> x2])
breps_box_4_after_operations_2 = Brep([<brep referenced from the Rhino model> x6])

# ---- group: Dont forget to change this when we are working with our extruded panels coz they are already retracted!!!!!!!!!!!!!
toggle = BooleanToggle(False)  # disabled

# ----
brep_3 = Brep([<brep referenced from the Rhino model> x12])

# ----
# Adjust threshold and distance b/w brackets as needed
number_slider = Slider(42, range=0..200)
number_slider_2 = Slider(90, range=0..300)

cut_getarea = Slider(175, range=0..200)

# ----
# Press bake to bake!
button = Button()
button_2 = Button()

panel = Panel("C:\Users\ahmed\OneDrive - Politecnico di Milano\ETH Zurich\HIWI\Neuramod Project\Neuramod-Support\Neuramod-Support\brackets_numbering\20230221_Brackets_panels_numbering.py")

# ---- group: Trimming Panels and Producing Boxes
panel_2 = Panel("C:\Users\ahmed\OneDrive - Politecnico di Milano\ETH Zurich\HIWI\Neuramod Project\Neuramod-Support\Neuramod-Support\utils\230305_wooden_box_cutting_tolerance.py")
panel_3 = Panel("C:\Users\ahmed\OneDrive - Politecnico di Milano\ETH Zurich\HIWI\Neuramod Project\Neuramod-Support\Neuramod-Support\utils\230305_wooden_box_layering.py")
panels_untrimmed_by_box = Brep([<brep referenced from the Rhino model> x10])
box_01_panels_untrimmed_by_box = Brep([<brep referenced from the Rhino model> x10])
box_14_panels_untrimmed_by_box = Brep([<brep referenced from the Rhino model> x7])
box_07_panels_untrimmed_by_box = Brep([<brep referenced from the Rhino model> x11])
panels_untrimmed_by_box_2 = Brep([<brep referenced from the Rhino model> x10])
box_18_panels_untrimmed_by_box = Brep([<brep referenced from the Rhino model> x10])
brep_4 = Brep(<brep referenced from the Rhino model>)
brep_5 = Brep(<brep referenced from the Rhino model>)
cap = CapHoles(Brep=brep_5)
read_file = ReadFile(File=panel_2, PerLineParse=False)
read_file_2 = ReadFile(File=panel_3, PerLineParse=False)
debrep = DeconstructBrep(Brep=brep_5)  # -> Faces, Edges, Vertices
volume = Volume(Geometry=cap)  # -> Volume, Centroid
ghpython_script = GhPythonScript(
    Code=read_file,
    Faces=debrep.Faces,
    Parent_layer_name="Box 18",
    Bake=Toggle(True),
    Panels=box_18_panels_untrimmed_by_box,
    Ids=box_18_panels_untrimmed_by_box,
    Scale_val=Slider(2, range=1..50),
    Move_value=Slider(0.5, range=0..50))  # -> Out, All_panels
ghpython_script_2 = GhPythonScript(Code=read_file_2, Faces=debrep.Faces, Cp_box=volume.Centroid, Parent_layer_name="Box 18", Bake=Toggle(True))
data = Data(ghpython_script.All_panels)
panel_4 = Panel(ghpython_script_2)
item = ListItem(List=data, Index=0, Wrap=True)  # -> Item1, Item
panel_5 = Panel(ghpython_script.Out)
cap_2 = CapHoles(Brep=data)
data_2 = Data(item.Item1)

# ---- group: original old file by Ananya
brep_6 = Brep([<brep referenced from the Rhino model> x20])  # disabled
python = GhPythonScript(breps=brep_6, ids=brep_6, threshold=number_slider, distance=number_slider_2, bake=button_2, bake_box=button)  # -> out, intersections, circs, tags, cricles, sm_edges, big_edges, p0s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; inputs breps: list of Brep, ids: list of Guid; disabled
# ---------- python: Python ----------
import Rhino.Geometry as rg
from ghpythonlib.treehelpers import list_to_tree as tree
import scriptcontext as sc
import Rhino.DocObjects as rd
import Rhino.DocObjects.ObjectAttributes as obj_att
from Rhino.RhinoDoc import ActiveDoc as doc
from Grasshopper.Kernel.GH_Convert import ToGUID as guid
import System.Collections.Generic.IEnumerable as IEnumerable
import System
import Rhino
from System import Array
from ghpythonlib.components import FilletEdge
import random as r

def GetObjectLayer(x):
    obj = doc.Objects.Find(x)
    index = obj.Attributes.LayerIndex
    layer = doc.Layers[index]
    return layer.Name

class Intersection(object):
    def __init__(self,crvs,layer,breps,layers):
        self.crvs = crvs
        self.layer = layer
        self.layers = layers
        self.breps = breps

def bake_object(obj,lay,col = 25):
    if obj is not None:
        attr = Rhino.DocObjects.ObjectAttributes()
    if lay is not None: # setting layer
        if rd.Layer.IsValidName(lay):
            layerIndex = sc.doc.Layers.Find(lay, True)
            if layerIndex < 0: # if the layer doesn't exist
                layer = rd.Layer()
                layer.Name = lay
                layer.Color = System.Drawing.Color.FromArgb(255,r.randint(0,255),0,r.randint(0,255))
                layerIndex = sc.doc.Layers.Add(layer)
            attr.LayerIndex = layerIndex
    
#    displayColor = Rhino.Display.ColorRGBA(layerIndex)
    sc.doc.Objects.AddBrep(obj, attr)

FAB_TOL = 0.15

B_TAGS = ('TO','BO','LF','RI','BA','IT','IB','IL','IR')

inter_radius = 10.0

cricles = []
sm_edges = []
big_edges = []
p0s = []
p1s = []
p01s = []
p02s = []

intersections = []
for brep0,id0 in zip(breps,ids):
    layer0 = GetObjectLayer(id0)
    for brep1,id1 in zip(breps,ids):
        layer1 = GetObjectLayer(id1)
        if (brep0 is not brep1) and (("%s-%s"%(layer0,layer1) not in [int.layer for int in intersections])) and (("%s-%s"%(layer1,layer0) not in [int.layer for int in intersections])) and (layer1 not in B_TAGS or layer0 not in B_TAGS):
#            print ("%s-%s"%(layer0,layer1)),"%s-%s"%(layer1,layer0), [int.layer for int in intersections]
            bbx = rg.Intersect.Intersection.BrepBrep(brep0,brep1,0.001)
            if bbx and len(bbx[1])>0:
                list_intersections = []
                for bx in bbx[1]:
                    if bx.GetLength() > 25:
                        list_intersections.append(bx)
                    else:
                        pass
                        #print 'small'
                interX = Intersection(list_intersections,"%s-%s"%(layer0,layer1),[brep0,brep1],[layer0,layer1])
                intersections.append(interX)

circs,tags = [],[]
for inter in intersections:
    for crv in inter.crvs:
        ts =  crv.DivideByCount(2,True)
        point,end = crv.PointAt(ts[1]),crv.PointAt(ts[2])
        if crv.GetLength()>distance*3:
            d_count = crv.GetLength()//distance
            params = crv.DivideByCount(d_count,True)
            pts = [crv.PointAt(t) for t in params[1:len(params)-1]]
        else:
            pts = [point]
        for pt in pts:
            pln = rg.Plane(pt,rg.Vector3d(end-point))
            circ = rg.Circle(rg.Plane(pt,rg.Vector3d(end-point)),inter_radius).ToNurbsCurve()
            plane = rg.Brep.CreatePlanarBreps([circ])[0]
            bpx0 = rg.Intersect.Intersection.BrepBrep(inter.breps[0],plane,0.001)
            bpx1 = rg.Intersect.Intersection.BrepBrep(inter.breps[1],plane,0.001)
            cutters = []
            if bpx0 and bpx1:
                cutters.extend([curve for curve in bpx0[1]])
                cutters.extend([curve for curve in bpx1[1]])
                cuts = plane.Split.Overloads[IEnumerable[rg.Curve], System.Double](cutters,0.001)
                
                for cut in cuts:
                    #print cut.GetArea()
                    count = 0
                    pcount = 0
                    flag = 0
                    for edge in cut.Edges:
                        count += 1
                        if edge.Degree == 1:
                            pcount += 1
                    if count>4 and cut.GetArea()>threshold and pcount>3:
                        edge_curves = [edge.EdgeCurve for edge in cut.Edges if edge.Degree == 1]
                        edge_curves.sort(key = lambda e :e.GetLength())
                        cricles.append(edge_curves)
                        edge_count = 0
                        for e in edge_curves:
                            if abs(e.GetLength() - inter_radius) < 0.1:
                                big_edge = e
                            edge_count +=1
                        small_edge = (edge_curves[3]) if (big_edge.ClosestPoint(edge_curves[1].PointAtStart,7.5)[0] or big_edge.ClosestPoint(edge_curves[1].PointAtEnd,7.5)[0]) and abs(edge_curves[1].GetLength()) > edge_curves[3].GetLength() else (edge_curves[3])
                        if edge_count<5:
                            small_edge = edge_curves[2]
                        sm_edges.append(small_edge)
                        big_edges.append(big_edge)
            #           small_edge = edge_curves[3] if edge_curves[2].GetLength()>edge_curves[3].GetLength() else edge_curves[2]
                        p0,p1 = (small_edge.PointAtStart,small_edge.PointAtEnd) if big_edge.ClosestPoint(small_edge.PointAtStart,7.5)[0] else (small_edge.PointAtEnd,small_edge.PointAtStart)
                        if big_edge.ClosestPoint(small_edge.PointAtStart,7.5)[0] and big_edge.ClosestPoint(small_edge.PointAtStart,7.5)[0]:
                            #print big_edge.ClosestPoint(small_edge.PointAtStart,7.5)[1],big_edge.ClosestPoint(small_edge.PointAtEnd,7.5)[1]
                            closest_pt_start = big_edge.PointAt(big_edge.ClosestPoint(small_edge.PointAtStart,7.5)[1])
                            start_dist = closest_pt_start.DistanceTo(small_edge.PointAtStart)
                            closest_pt_end = big_edge.PointAt(big_edge.ClosestPoint(small_edge.PointAtEnd,7.5)[1])
                            end_dist = closest_pt_end.DistanceTo(small_edge.PointAtEnd)
                            if start_dist<end_dist:
                                p0,p1 = small_edge.PointAtStart,small_edge.PointAtEnd
                            else:
                                p0,p1 = small_edge.PointAtEnd,small_edge.PointAtStart
                        pp0,pp1 = (big_edge.PointAtStart,big_edge.PointAtEnd) if small_edge.ClosestPoint(big_edge.PointAtStart,7.5)[0] else (big_edge.PointAtEnd,big_edge.PointAtStart)

                        p01s.append(pp0) 
                        p02s.append(pp1) 
                        #rebuild small and big edge for length
                        vec = rg.Vector3d(p1 - p0)
                        line = rg.Line(p0,vec,25.0 + FAB_TOL).ToNurbsCurve()
                        small_edge = line
                        vec1 = rg.Vector3d(pp1 - pp0)
                        line1 = rg.Line(pp0,vec1,25.0 + FAB_TOL).ToNurbsCurve()
                        big_edge = line1
                        big_edge.Domain = rg.Interval(0,1)
                        c_pt = big_edge.PointAt(0.5)
                        clo_pt0 = (inter.breps[0]).ClosestPoint(c_pt,1.0) 
                        clo_pt1 = (inter.breps[1]).ClosestPoint(c_pt,1.0)
                        p0s.append(clo_pt0[1])
                        p1s.append(clo_pt1[1]) 
                        guide_vec = (clo_pt0[5]) if (clo_pt0[0]) else None
                        #print inter.layer
                        #push back big_edge
                        box_type = 0
                        if not (inter.layer.Split('-')[0] in B_TAGS or inter.layer.Split('-')[1] in B_TAGS):
                            if guide_vec is None and clo_pt1[0] :
                                guide_vec = clo_pt1[5]
                            guide_vec.Unitize()
                            guide_vec *= -3.20
                            big_edge.Translate(guide_vec)
                        else:
                            box_type = 1
                        if small_edge and big_edge is not None:
                            fil = rg.Curve.CreateFilletCurves(small_edge,p0,big_edge,pp0,0,True,True,True,True,0.01)
                            #print fil
#                            rg.PolyCurve.SegmentCurve
                            if fil[0].SegmentCount<2 or min([fil[0].SegmentCurve(i).GetLength() for i in range(fil[0].SegmentCount)])<20:
                                #print 'fli'
                                fil = rg.Curve.CreateFilletCurves(small_edge,p0,big_edge, pp1,0,True,True,True,True,0.01)
                            fil = fil[0] if len(fil)==1 else None
                            off = fil.Offset(rg.Point3d((fil.PointAtEnd+fil.PointAtStart)/2),rg.Plane(fil.PointAtEnd,fil.PointAtStart,fil.PointAt(0.5)).ZAxis,3.2,0.01,0.01,False,rg.CurveOffsetCornerStyle.Sharp,rg.CurveOffsetEndStyle.Flat)
                            if not box_type: b1,b2 = rg.Extrusion.Create(off[0].ToNurbsCurve(),9.0 + FAB_TOL, True),rg.Extrusion.Create(off[0].ToNurbsCurve(),-9.0 - FAB_TOL,True)
                            else : b1,b2 = rg.Extrusion.Create(off[0].ToNurbsCurve(),15.0 + FAB_TOL, True),rg.Extrusion.Create(off[0].ToNurbsCurve(),-15.0 - FAB_TOL,True)
                            if b1 and b2 is not None:
                                x1 = b1.ToBrep()
                                x2 = b2.ToBrep()
                                bool = rg.Brep.CreateBooleanUnion([x1,x2],0.001)
                                if len(bool)==1:
                                    bool[0].MergeCoplanarFaces(0.00,0.001)
                                    bool = bool[0]
                                else:
                                    print 'Boolean not created, check breps'
                            else:
                                print 'Bad Offset Curve, Extrusion not created.'
                            fillet_indices = []
                            
                            for edge in bool.Edges:
                                if abs(edge.EdgeCurve.GetLength() - 3.2) < 0.5:
                                    num =  edge.EdgeIndex
                                    fillet_indices.append(num)
                            indices = fillet_indices
                            bbe = rg.Brep.CreateFilletEdges(bool,indices,[2.0 for _ in range(len(indices))],[2.0 for _ in range(len(indices))],rg.BlendType.Fillet,rg.RailType.RollingBall,0.0001)
                        bbe = bbe[0]
                        circs.append([small_edge,big_edge,cut])
                        circs.append(bbe)
                        tags.append(inter.layer)
    
sc.doc = doc

for tag in tags:
    if tag.Split('-')[0] in B_TAGS or tag.Split('-')[1] in B_TAGS:
        pass

if bake:
    for part,tag in zip(circs,tags):
        bake_object(part,tag)

if bake_box:
    for part,tag in zip(circs,tags):
        if tag.Split('-')[0] in B_TAGS or tag.Split('-')[1] in B_TAGS:
            bake_object(part,tag)
    
sc.doc = ghdoc

intersections = intersections
circs = tree(circs)
# ---------- end python ----------
python_2 = GhPythonScript(inter=python.intersections)  # -> out, a, b; inputs inter: list; disabled
# ---------- python_2: Python ----------
import Rhino.Geometry as rg

a,b= [],[]
for int in inter:
    a.extend(int.crvs)
    b.append(int.layer)
# ---------- end python_2 ----------

# Input baked geometry to generate holding brackets
brep_7 = Brep([<brep referenced from the Rhino model> x12])  # disabled
data_3 = Data(python.big_edges)  # disabled
data_4 = Data(python.sm_edges)  # disabled
data_5 = Data(python.p1s)  # disabled
data_6 = Data(python.p01s)  # disabled
data_7 = Data(python.p02s)  # disabled
data_8 = Data(python.p0s)  # disabled
python_3 = GhPythonScript(x=python.cricles)  # -> out, a; disabled
# ---------- python_3: Python ----------
a = x
# ---------- end python_3 ----------
data_9 = Data(python.sm_edges)  # disabled
data_10 = Data(python.cricles)  # disabled
ln = Line(StartPoint=python.p0s, EndPoint=python.p1s)  # disabled
data_11 = Data(python_2.a)  # disabled
ln_2 = Line(StartPoint=python.p01s, EndPoint=python.p02s)  # disabled
item_2 = ListItem(List=brep_6, Index=0, Wrap=True)  # -> Item, Item1, Item2, Item3, Item4, Item5, Item6, Item7; disabled
data_12 = Data(item_2.Item6)  # disabled
data_13 = Data(item_2.Item)  # disabled

knob = ControlKnob(Decimals=0, Limit=True, Maximum=50, Minimum=0, Range=10, Value=3)  # disabled
item_3 = ListItem(List=brep_6, Index=knob, Wrap=True)  # disabled
data_14 = Data(item_3)  # disabled

number_slider_3 = Slider(1083, range=100..20000)  # disabled
Z = UnitZ(Factor=number_slider_3)  # disabled
move = Move(Geometry=python_3.a, Motion=Z)  # -> Geometry, Transform; disabled

# ----
box_18__breps_after_operations = Brep([<brep referenced from the Rhino model> x9])
box_18__breps_after_operations_2 = Brep([<brep referenced from the Rhino model> x10])
add_b_tol = Slider(0.7, range=0..2)
number_slider_4 = Slider(0.8, range=0..2)

number_slider_5 = Slider(0.001, range=0..0.001)  # disabled
p_n_c = PickNChoose(Pattern=toggle, Stream0=number_slider_4, Stream1=number_slider_5)  # disabled

panel_6 = Panel(p_n_c)  # disabled
box_number = Slider(18, range=0..33)
move_text_distance2 = Slider(30, range=1..50)
brep_8 = Brep([<brep referenced from the Rhino model> x10])
item_4 = ListItem(List=box_18__breps_after_operations, Index=Slider(2, range=0..12), Wrap=True)
item_5 = ListItem(List=box_18__breps_after_operations_2, Index=Slider(10, range=0..12), Wrap=True)
read_file_3 = ReadFile(File=panel, PerLineParse=False)
merge = Merge(Data1=item_5, Data2=item_4)
# Remaining
# - Solve the bug in creating the proper planes (done)
# - creating a function that loops through the panel number based on its number or id and remove the part of the bracket from it !! (check if ananya had already done something like this-no)(done)
# - Adjust the writing of the code comments# to understand the whole process.(pending)
toggle_2 = BooleanToggle(True)
data_15 = Data(item_4)
ghpython_script_3 = GhPythonScript(
    Code=read_file_3,
    Breps=merge,
    Ids=merge,
    Threshold=number_slider,
    Max_area_threshold=cut_getarea,
    Distance=number_slider_2,
    Bake=button_2,
    Bake_box=button,
    Inter_tol_breps=number_slider_4,
    Add_B_tol=add_b_tol,
    Dup_lines_tol=Slider(2.686, range=0..5),
    Box_number=box_number,
    Move_text_distance1=Slider(25, range=1..50),
    Move_text_distance2=move_text_distance2,
    Get_panels=toggle_2)  # -> Out, Intersections, Circs, Tags, Lines, port, Debgging, port_2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

# ---- group: Trimming Panels and Producing Boxes
md_slider = MDSlider(SliderMode=0, slider_value=Point(0.5, 0.5, 0.5), x_domain=Domain(0, 1), y_domain=Domain(0, 1), z_domain=Domain(0, 1))
evalsrf = EvaluateSurface(Surface=reparameterize(debrep.Faces), Point=md_slider)  # -> Point, Normal, UDirection, VDirection, Frame
vdis = VectorDisplay(Anchor=evalsrf.Point, Vector=evalsrf.Normal)

# ----
data_16 = Data(ghpython_script_3.Sm_edges)
data_17 = Data(ghpython_script_3.Circles)
data_18 = Data(ghpython_script_3.Big_edges)
python_4 = GhPythonScript(inter=ghpython_script_3.Intersections)  # -> out, a, b; inputs inter: list; same code as python_2
data_19 = Data(ghpython_script_3.P1s)
python_5 = GhPythonScript(x=ghpython_script_3.P1s)  # -> out, a
# ---------- python_5: Python ----------
x = a
# ---------- end python_5 ----------

X = UnitX(Factor=reverse(Slider(7302, range=100..10000)))
move_2 = Move(Geometry=ghpython_script_3.All_panels, Motion=reverse(X))  # -> Geometry, Transform

panel_7 = Panel(ghpython_script_3.Out)
end = EndPoints(Curve=data_16)  # -> Start, End
data_20 = Data(simplify(flatten(ghpython_script_3.Circs)))
vdis_2 = VectorDisplay(Vector=data_19)
data_21 = Data(end.End)
data_22 = Data(end.Start)
knob_2 = ControlKnob(Decimals=0, Limit=True, Maximum=500, Minimum=0, Range=10, Value=1)
null = NullItem(Item=data_20)  # -> NullFlags, InvalidFlags, Description
dispatch = Dispatch(List=data_20, DispatchPattern=null.NullFlags)  # -> ListA, RealBracket

knob_3 = ControlKnob(Decimals=0, Limit=True, Maximum=500, Minimum=0, Range=10, Value=4)
python_6 = GhPythonScript()  # -> out, simplify(a); same code as python_3
path = ConstructPath(Indices=knob_3)
branch = TreeBranch(Tree=python_6.a, Path=path, MaintainPaths=True)

item_6 = ListItem(List=move_2.Geometry, Index=knob_2, Wrap=True)

pln = Plane(ghpython_script_3.Planes_txt)
bool = Boolean(False)
txt = Text(ghpython_script_3.Tag_txt)
text = Text(Location=pln, Text=txt, Size=Slider(2, range=0..50), Bold=bool, HorizontalAlignment=0, VerticalAlignment=0)

X_2 = UnitX(Factor=reverse(Slider(1468, range=100..10000)))

# ---- group: Real Brackets !!!
data_23 = Data(dispatch.RealBracket)

# ----
move_3 = Move(Motion=reverse(X_2))  # -> Geometry, Transform
python_7 = GhPythonScript()  # -> out, simplify(flatten(a)); same code as python_3
python_8 = GhPythonScript(x=python_7.a)  # -> out, simplify(flatten(a)); same code as python_3
